# Grasshopper definition ST03_discretisation_updated_sienna_230205.gh (Grasshopper 1.0.7)
# plug-ins: Bifocals, MeshEdit Components, Weaverbird, SDPlatform, Wombat, Kangaroo Components, Human, ABxM.Grasshopper, Kangaroo2 Components

longitidunal_curves = Curve([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])
mesh = Mesh(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)

# ----
# Discretisation
panel = Panel("")

# ----
# Inputs from Rhino Vault
longitudinal_stress_crvs = Curve([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])
vertical_stress_crvs = Curve([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])
# Inputs
mesh_2 = Mesh(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)

# ----
# ABxM Planarization
panel_2 = Panel("")

# ----
# Inputs from Karamba
longitudinal_stress_crvs_2 = Curve([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])
vertical_stress_crvs_2 = Curve([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])
mesh_3 = Mesh(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)

discretised_panel_crvs = Geometry(Tree({0}: [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], {1}: [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], {2}: [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], {3}: [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], {4}: [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], {5}: [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], {6}: [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], {7}: [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], {8}: [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], {9}: [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], {10}: [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]))
pt = Point(Tree({0}: [Point(-28.80869571, -5.488914704, 0), Point(-29.2844646, -4.778138399, 0), Point(-29.79644902, -3.877004597, 0), Point(-29.99335224, -3.46238897, 0), Point(-30.25587384, -2.809057482, 0), Point(-30.50013904, -2.004107651, 0), Point(-30.69197586, -0.9352037661, 0), Point(-30.73847423, -0.007161663742, 0), Point(-30.67610532, 0.9183202302, 0), Point(-30.47291596, 1.982860355, 0), Point(-30.22863941, 2.785337783, 0), Point(-29.97305492, 3.438443243, 0), Point(-29.78296623, 3.856696825, 0), Point(-29.29272298, 4.774939497, 0), Point(-28.84109311, 5.506991603, 0)], {1}: [Point(-28.59566322, -4.702266076, 0.512305494), Point(-28.98260527, -4.198018695, 0.6221769549), Point(-29.45837838, -3.554111056, 0.7600760078), Point(-29.67660694, -3.17551677, 0.8208070497), Point(-29.94901277, -2.550056838, 0.8698722881), Point(-30.18818816, -1.788380392, 0.8979182908), Point(-30.34209899, -0.8235899472, 0.9133036276), Point(-30.39826479, -0.007119332409, 0.9193109429), Point(-30.33055222, 0.8082303327, 0.9139828195), Point(-30.16863904, 1.769642979, 0.8999842004), Point(-29.92819336, 2.525546695, 0.8704121781), Point(-29.65476188, 3.148448906, 0.8165072591), Point(-29.44305622, 3.524172231, 0.7534218269), Point(-28.98790105, 4.19094644, 0.6127017661), Point(-28.61991224, 4.716731228, 0.5014389827)], {2}: [Point(-28.27839806, -3.949658279, 1.00408241), Point(-28.60293308, -3.6146853, 1.209340382), Point(-29.02109468, -3.161623792, 1.473068222), Point(-29.25589625, -2.835264454, 1.608030921), Point(-29.5456521, -2.271439021, 1.724803086), Point(-29.78507753, -1.57717988, 1.789946313), Point(-29.92577464, -0.7244462115, 1.823494821), Point(-29.97393887, -0.007078600984, 1.835615731), Point(-29.91516889, 0.7087982172, 1.823296825), Point(-29.76574056, 1.558300895, 1.789444409), Point(-29.52567291, 2.244409392, 1.722135093), Point(-29.23624274, 2.802264558, 1.599354169), Point(-29.00905063, 3.127020658, 1.461568477), Point(-28.61611456, 3.618786925, 1.183900006), Point(-28.31318955, 3.991643072, 0.9654561548)], {3}: [Point(-27.83599208, -3.230265905, 1.452128725), Point(-28.1262365, -3.007578246, 1.72136721), Point(-28.50030369, -2.680545088, 2.071073851), Point(-28.71195059, -2.397368835, 2.261354697), Point(-28.98691387, -1.91459513, 2.45176307), Point(-29.21353537, -1.329046441, 2.571985415), Point(-29.3378626, -0.6147480844, 2.630968366), Point(-29.38004922, -0.007032860858, 2.652231066), Point(-29.33012954, 0.5994700314, 2.631551326), Point(-29.1981955, 1.306965485, 2.570434469), Point(-28.96989998, 1.883364918, 2.445133008), Point(-28.69813478, 2.36115577, 2.252148292), Point(-28.49304836, 2.649062344, 2.063081484), Point(-28.1402815, 3.012270417, 1.69651923), Point(-27.86830028, 3.268186799, 1.409520222)], {4}: [Point(-27.30432301, -2.598221043, 1.783911967), Point(-27.5641778, -2.415535437, 2.099473837), Point(-27.89133729, -2.138140193, 2.510996065), Point(-28.05831841, -1.882948056, 2.731278097), Point(-28.26750211, -1.475808861, 2.95822554), Point(-28.42835427, -1.026332881, 3.107225916), Point(-28.51600677, -0.4821067501, 3.185950188), Point(-28.54745633, -0.007009656779, 3.217083888), Point(-28.50970185, 0.4675862396, 3.186898272), Point(-28.41519374, 1.00516496, 3.104619387), Point(-28.25181425, 1.451382644, 2.951818516), Point(-28.04671103, 1.853956578, 2.726690826), Point(-27.88467242, 2.109617316, 2.50567024), Point(-27.563857, 2.401531909, 2.084658316), Point(-27.30748268, 2.598274778, 1.759889138)], {5}: [Point(-26.67581171, -2.047481259, 1.944372054), Point(-26.89879304, -1.871362109, 2.289607047), Point(-27.17071495, -1.601441732, 2.729515888), Point(-27.28598546, -1.362430514, 2.943818708), Point(-27.41273622, -1.031464142, 3.146405444), Point(-27.49859056, -0.7109853437, 3.271571542), Point(-27.54081115, -0.340514742, 3.343645033), Point(-27.55610577, -0.006981659395, 3.373010131), Point(-27.5352891, 0.3247077828, 3.342402532), Point(-27.48715466, 0.6917281622, 3.267632611), Point(-27.4001309, 1.007595607, 3.140169871), Point(-27.27574621, 1.335636553, 2.936861049), Point(-27.16355974, 1.575289189, 2.723590531), Point(-26.88061036, 1.847545868, 2.273269447), Point(-26.64472541, 2.025287752, 1.917173365)], {6}: [Point(-25.89293122, -1.564065334, 1.851750264), Point(-26.10219395, -1.421976214, 2.212901965), Point(-26.34259295, -1.195046918, 2.662086232), Point(-26.41783365, -0.9747990164, 2.857932243), Point(-26.49484587, -0.6943430623, 3.030687383), Point(-26.5402195, -0.4611934614, 3.125186225), Point(-26.55799242, -0.2173658011, 3.169734084), Point(-26.56347425, -0.00704550836, 3.186604869), Point(-26.55371496, 0.2020965953, 3.166911007), Point(-26.53121745, 0.4439234625, 3.11801687), Point(-26.48353226, 0.6761811892, 3.022521433), Point(-26.40797522, 0.9542035696, 2.850690933), Point(-26.33614397, 1.174793864, 2.656162219), Point(-26.10269903, 1.41354544, 2.199625721), Point(-25.89836364, 1.566722093, 1.829462075)], {7}: [Point(-25.18137061, -1.256580253, 1.611337924), Point(-25.34906655, -1.1061382, 1.942775223), Point(-25.53239548, -0.8861748713, 2.34084604), Point(-25.5741058, -0.702829643, 2.498548373), Point(-25.61721466, -0.4814220441, 2.633819359), Point(-25.64358808, -0.3108812814, 2.703206519), Point(-25.65247782, -0.1446810955, 2.733208385), Point(-25.65503595, -0.007047871701, 2.743640621), Point(-25.64918498, 0.1299980927, 2.730549065), Point(-25.63632439, 0.2953379997, 2.697165631), Point(-25.60869934, 0.4645403079, 2.626386981), Point(-25.56659015, 0.6848442109, 2.491247251), Point(-25.52686617, 0.868259611, 2.335175271), Point(-25.34169587, 1.094569569, 1.928217443), Point(-25.17072846, 1.251133669, 1.586742196)], {8}: [Point(-24.58368845, -1.064511099, 1.290172075), Point(-24.67138877, -0.9048797385, 1.554129195), Point(-24.76532725, -0.6863385525, 1.867343007), Point(-24.78380496, -0.5306159495, 1.984575539), Point(-24.80631055, -0.3514517342, 2.082744917), Point(-24.8216092, -0.2213824859, 2.131608542), Point(-24.82635937, -0.1013686717, 2.151719433), Point(-24.82759621, -0.007058890515, 2.158490465), Point(-24.82387366, 0.08704515912, 2.14977572), Point(-24.81641562, 0.2066661738, 2.126758154), Point(-24.80033018, 0.3360686118, 2.076500324), Point(-24.7783783, 0.5146745046, 1.97853269), Point(-24.76138134, 0.6703344135, 1.862593312), Point(-24.66778321, 0.8946757096, 1.54316188), Point(-24.57948845, 1.060049667, 1.272051698)], {9}: [Point(-24.00067363, -0.9257878708, 0.9014102895), Point(-24.02612936, -0.7679491416, 1.081033449), Point(-24.05148421, -0.5596560952, 1.293429258), Point(-24.05249064, -0.4259725055, 1.372254263), Point(-24.05798219, -0.2758568722, 1.439263728), Point(-24.06409709, -0.1713435546, 1.471984359), Point(-24.06579708, -0.07791336519, 1.484941763), Point(-24.0661813, -0.007070544747, 1.489185508), Point(-24.06440443, 0.06366769832, 1.483370873), Point(-24.06113797, 0.1568922994, 1.46823908), Point(-24.05449194, 0.2611483086, 1.434590619), Point(-24.0493438, 0.410920624, 1.367722648), Point(-24.04927925, 0.5443979567, 1.289759107), Point(-24.02435237, 0.757220371, 1.073300423), Point(-23.99879427, 0.9195909128, 0.8889917921)], {10}: [Point(-23.43259484, -0.8355080837, 0.467700336), Point(-23.41035898, -0.6735739719, 0.5557420434), Point(-23.38313516, -0.4680156507, 0.6603304478), Point(-23.37163496, -0.3516786742, 0.6999350557), Point(-23.36553259, -0.2239182808, 0.7334856343), Point(-23.36508506, -0.138145875, 0.7494357031)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], {11}: [Point(-22.87058919, -0.7996153203, 0), Point(-22.82660419, -0.6461295496, 0), Point(-22.78369749, -0.4509432217, 0), Point(-22.76568799, -0.336155747, 0), Point(-22.75200316, -0.2096034755, 0), Point(-22.7466316, -0.1283328095, 0), Point(-22.7441604, -0.05884679012, 0), Point(-22.74359157, -0.007090404514, 0), Point(-22.74410938, 0.04466764464, 0), Point(-22.74651467, 0.1141581249, 0), Point(-22.75181724, 0.1954379592, 0), Point(-22.76542432, 0.3220091247, 0), Point(-22.7834084, 0.4368115757, 0), Point(-22.82639811, 0.6319657613, 0), Point(-22.87058919, 0.7853739447, 0)]))

planarized_srfs_directly_from_abm = Surface([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])
manually_repaired_srfs = Surface([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])
circle_packing_geo = Geometry([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])  # disabled
panel_3 = Panel(circle_packing_geo)
merge = Merge(Data1=planarized_srfs_directly_from_abm, Data2=manually_repaired_srfs)
join = BrepJoin(Breps=flatten(merge))  # -> Breps, Closed
brep = Brep(join.Breps)
panel_4 = Panel(brep)

# ----
# After Planarization
panel_5 = Panel("")

# ----
# 1. clean up the stress curves (longitudinal):
# a1. join the curves if possible
# a2. delete the stress lines that are shorter than the threshold length
python = GhPythonScript(iCrvs=longitidunal_curves)  # -> out, oIndices; inputs iCrvs: list of Curve
# ---------- python: Python ----------
import Rhino.Geometry as rg
import ghpythonlib.treehelpers as th


indexTree = [[]]
for i in range(0, len(iCrvs)):
    myCrv = iCrvs[i]
    myCrv.Domain = rg.Interval(0,1)
    pointA = myCrv.PointAt(0.0)
    pointB = myCrv.PointAt(1.0)
    
    indexPair = []
    indexPair.append(i)
    
    for j in range(0, len(iCrvs)):
        otherCrv = iCrvs[j]
        otherCrv.Domain = rg.Interval(0,1)
        pointC = otherCrv.PointAt(0.0)
        pointD = otherCrv.PointAt(1.0)

        if pointA == pointC or pointA == pointD or pointB == pointC or pointB == pointD:
            indexPair.append(j)
        else:
            continue

    indexTree.append(list(set(indexPair)))
    
    
#if any two sublists are same, remove one from the nested list
def Remove(lst):
     res = []
     check = set()
  
     for x in lst:
         hsh = tuple(sorted(x))
         if hsh not in check:
             res.append(x)
             check.add(hsh)
               
     return res 

oIndices = th.list_to_tree(Remove(indexTree))
# ---------- end python ----------
clean = CleanTree(RemoveNulls=True, RemoveInvalid=True, RemoveEmpty=True, Tree=python.oIndices)
item = ListItem(List=longitidunal_curves, Index=clean, Wrap=True)
join_2 = JoinCurves(Curves=item, Preserve=False)  # -> simplify(Curves)
joined_curves = Curve(flatten(join_2))
len = Length(Curve=joined_curves)
sort = SortList(Keys=len, ValuesA=joined_curves)  # -> Keys, ValuesA
avr = Average(Input=sort.Keys)
expression = Expression(avg=avr, tolerence=Slider(0.09, range=0..1), Expression="avg*(1-tolerence)")
larger = LargerThan(FirstNumber=sort.Keys, SecondNumber=expression)  # -> LargerThan, OrEqualTo

# ----
# 0. Deconstruct the global geo mesh to get:
# a) the naked boundary curves
mesh_4 = Mesh(mesh)
deconstruct_mesh = DeconstructMesh(Mesh=mesh_4)  # -> Vertices, Faces, Colours, Normals
wbnaked = WeaverbirdsNakedBoundary(MeshClosedPolylines=mesh_4)
range = Range(Domain=Domain(0, 1), Steps=Slider(99, range=0..100))
mesh_naked_outlines = Curve(wbnaked)
deconstruct = Deconstruct(Point=deconstruct_mesh.Vertices)  # -> XComponent, YComponent, ZComponent
threshold_to_locate_ground_pts = Slider(0.19, range=0..3)
panel_6 = Panel(range)
evaluate_curve = EvaluateCurve(Curve=reparameterize(mesh_naked_outlines), Parameter=range)  # -> Point, Tangent, Angle
smaller = SmallerThan(FirstNumber=deconstruct.ZComponent, SecondNumber=threshold_to_locate_ground_pts)  # -> SmallerThan, OrEqualTo
crv_cp = CurveClosestPoint(Point=deconstruct_mesh.Vertices, Curve=wbnaked)  # -> Point, Parameter, Distance
pdecon = Deconstruct(Point=crv_cp.Point)  # -> XComponent, YComponent, ZComponent
dispatch = Dispatch(List=deconstruct_mesh.Vertices, DispatchPattern=smaller.SmallerThan)  # -> ListA, ListB
smaller_2 = SmallerThan(FirstNumber=pdecon.ZComponent, SecondNumber=threshold_to_locate_ground_pts)  # -> SmallerThan, OrEqualTo
points_on_ground = Point(dispatch.ListA)
area = MeshArea(Mesh=mesh_4)  # -> Area, Centroid
dispatch_2 = Dispatch(List=crv_cp.Point, DispatchPattern=smaller_2.SmallerThan)  # -> ListA, ListB
deconstruct_2 = Deconstruct(Point=points_on_ground)  # -> XComponent, YComponent, ZComponent
mesh_center_pt = Point(area.Centroid)
pts_not_on_ground = Point(dispatch_2.ListB)
sort_list = SortList(Keys=deconstruct_2.XComponent, ValuesValuesA=points_on_ground)  # -> Keys, ValuesValuesA
pdecon_2 = Deconstruct(Point=pts_not_on_ground)  # -> XComponent, YComponent, ZComponent
pdecon_3 = Deconstruct(Point=mesh_center_pt)  # -> XComponent, YComponent, ZComponent
pdecon_4 = Deconstruct(Point=sort_list.ValuesValuesA)  # -> XComponent, YComponent, ZComponent
smaller_3 = SmallerThan(FirstNumber=pdecon_4.XComponent, SecondNumber=pdecon_3.XComponent)  # -> SmallerThan, OrEqualTo
smaller_4 = SmallerThan(FirstNumber=pdecon_2.YComponent, SecondNumber=pdecon_3.YComponent)  # -> SmallerThan, OrEqualTo
dispatch_3 = Dispatch(List=pts_not_on_ground, DispatchPattern=smaller_4.SmallerThan)  # -> ListA, ListB
dispatch_4 = Dispatch(List=sort_list.ValuesValuesA, DispatchPattern=smaller_3.SmallerThan)  # -> ListA, ListB
mesh_points_on_ground_shorter_edge = Point(dispatch_4.ListB)
mesh_points_on_ground_long_edge = Point(dispatch_4.ListA)
mesh_points_on_the_other_edge = Point(dispatch_3.ListB)
mesh_points_on_one_edge = Point(dispatch_3.ListA)
pdecon_5 = Deconstruct(Point=mesh_points_on_the_other_edge)  # -> XComponent, YComponent, ZComponent
pdecon_6 = Deconstruct(Point=mesh_points_on_one_edge)  # -> XComponent, YComponent, ZComponent
pdecon_7 = Deconstruct(Point=mesh_points_on_ground_shorter_edge)  # -> XComponent, YComponent, ZComponent
pdecon_8 = Deconstruct(Point=mesh_points_on_ground_long_edge)  # -> XComponent, YComponent, ZComponent
sort_2 = SortList(Keys=pdecon_5.XComponent, ValuesA=mesh_points_on_the_other_edge)  # -> Keys, ValuesA
sort_3 = SortList(Keys=pdecon_6.XComponent, ValuesA=mesh_points_on_one_edge)  # -> Keys, ValuesA
sort_4 = SortList(Keys=pdecon_7.YComponent, ValuesA=mesh_points_on_ground_shorter_edge)  # -> Keys, ValuesA
sort_5 = SortList(Keys=pdecon_8.YComponent, ValuesA=mesh_points_on_ground_long_edge)  # -> Keys, ValuesA
sorted_mesh_points_on_ground_lshorter_ed = Point(sort_4.ValuesA)  # "Sorted Mesh points on ground (lshorter edge)"
sorted_mesh_points_on_ground_long_edge = Point(sort_5.ValuesA)
sorted_mesh_points_on_the_other_edge = Point(sort_2.ValuesA)
sorted_mesh_points_on_one_edge = Point(sort_3.ValuesA)
item_2 = ListItem(List=sorted_mesh_points_on_ground_long_edge, Index=0, Wrap=True)  # -> Item1, Item
item_3 = ListItem(List=sorted_mesh_points_on_ground_lshorter_ed, Index=0, Wrap=True)  # -> Item1, Item
pt_2 = Point(item_2.Item)
pt_3 = Point(item_3.Item)
ins = InsertItems(List=sorted_mesh_points_on_one_edge, Item=pt_2, Indices=0, Wrap=True)
ins_2 = InsertItems(List=sorted_mesh_points_on_the_other_edge, Item=item_2.Item1, Indices=0, Wrap=True)
nurbs = NurbsCurve(Vertices=sorted_mesh_points_on_ground_lshorter_ed, Degree=3, Periodic=False)  # -> Curve, Length, Domain
nurbs_2 = NurbsCurve(Vertices=sorted_mesh_points_on_ground_long_edge, Degree=3, Periodic=False)  # -> Curve, Length, Domain
ins_3 = InsertItems(List=ins, Item=pt_3, Indices=-1, Wrap=True)
ins_4 = InsertItems(List=ins_2, Item=item_3.Item1, Indices=-1, Wrap=True)
intcrv = Interpolate(Vertices=sorted_mesh_points_on_ground_long_edge, Degree=3, Periodic=False, KnotStyle=1)  # -> Curve, Length, Domain
intcrv_2 = Interpolate(Vertices=ins_3, Degree=3, Periodic=False, KnotStyle=0)  # -> Curve, Length, Domain
intcrv_3 = Interpolate(Vertices=sorted_mesh_points_on_ground_lshorter_ed, Degree=3, Periodic=False, KnotStyle=1)  # -> Curve, Length, Domain
intcrv_4 = Interpolate(Vertices=ins_4, Degree=3, Periodic=False, KnotStyle=0)  # -> Curve, Length, Domain
bottom_edge_short = Curve(nurbs.Curve)
bottom_edge_long = Curve(nurbs_2.Curve)
above_ground_edge_1 = Curve(intcrv_2.Curve)
above_ground_edge_2 = Curve(intcrv_4.Curve)
merge_2 = Merge(Data1=bottom_edge_long, Data2=bottom_edge_short, Data3=above_ground_edge_1, Data4=above_ground_edge_2)
mesh_naked_boundaries_4_edges = Curve(merge_2)

wires = BrepWireframe(Brep=brep, Density=-1)

# ----
# 1. clean up the stress curves (vertical):
# a. re-orient the curve directions
area_2 = MeshArea(Mesh=mesh)  # -> Area, Centroid; disabled
end = EndPoints(Curve=vertical_stress_crvs)  # -> Start, End; disabled
pdecon_9 = Deconstruct(Point=area_2.Centroid)  # -> XComponent, YComponent, ZComponent; disabled
pdecon_10 = Deconstruct(Point=end.Start)  # -> XComponent, YComponent, ZComponent; disabled
smaller_5 = SmallerThan(FirstNumber=pdecon_10.YComponent, SecondNumber=pdecon_9.YComponent)  # -> SmallerThan, OrEqualTo; disabled
dispatch_5 = Dispatch(List=vertical_stress_crvs, DispatchPattern=smaller_5.SmallerThan)  # -> ListA, ListB; disabled
flip = FlipCurve(Curve=dispatch_5.ListA)  # -> Curve, Flag; disabled
merge_3 = Merge(Data1=flip.Curve, Data2=dispatch_5.ListB)  # disabled

cull = CullPattern(List=sort.ValuesA, CullPattern=larger.LargerThan)

# ----
# 1. clean up the stress curves (vertical):
# b. remove the significantly short curves
midpt = CurveMiddle(Curve=merge_3)  # disabled
rangetolerance = Slider(2550.35, range=0..5000)  # disabled
pdecon_11 = Deconstruct(Point=midpt)  # -> XComponent, YComponent, ZComponent; disabled
bnd = Bounds(Numbers=pdecon_11.YComponent)  # disabled
python_2 = GhPythonScript(yVal=pdecon_11.YComponent, centerY=pdecon_9.YComponent, iTolerance=rangetolerance)  # -> out, cullingPattern; inputs yVal: list; disabled
# ---------- python_2: Python ----------
minY = centerY -iTolerance
maxY = centerY +iTolerance
print minY, maxY

cullingPattern = []
for y in yVal:
    if y < maxY and y > minY:
        result = 1
    else:
        result = 0
    cullingPattern.append(result)
    print y, result
# ---------- end python_2 ----------
dispatch_6 = Dispatch(List=merge_3, DispatchPattern=python_2.cullingPattern)  # -> ListA, ListB; disabled
selected_curves = Geometry(dispatch_6.ListA)  # disabled

# ----
# 1. clean up the stress curves (longitudinal):
# b. re-orient the direction of the curves
end_2 = EndPoints(Curve=cull)  # -> Start, End
pt_4 = Point(end_2.Start)
area_3 = MeshArea(Mesh=mesh_4)  # -> Area, Centroid
pdecon_12 = Deconstruct(Point=end_2.Start)  # -> XComponent, YComponent, ZComponent
pdecon_13 = Deconstruct(Point=area_3.Centroid)  # -> XComponent, YComponent, ZComponent
larger_2 = LargerThan(FirstNumber=pdecon_12.XComponent, SecondNumber=pdecon_13.XComponent)  # -> LargerThan, OrEqualTo
dispatch_7 = Dispatch(List=cull, DispatchPattern=larger_2.LargerThan)  # -> ListA, ListB
flip_2 = FlipCurve(Curve=dispatch_7.ListA)  # -> Curve, Flag
merge_4 = Merge(Data1=flip_2.Curve, Data2=dispatch_7.ListB)

geo = Geometry(dispatch_7.ListA)
crv_re_aligned_olong_y = Curve(merge_4)

# ----
# 1. clean up the stress curves (vertical):
# c. delete the stress lines that are too
# close to its neighboring curves (including the duplicate ones)
end_3 = EndPoints(Curve=selected_curves)  # -> Start, End; disabled
pt_5 = Point(end_3.Start)  # disabled
pdecon_14 = Deconstruct(Point=pt_5)  # -> XComponent, YComponent, ZComponent; disabled
number_slider = Slider(33, range=0..33)  # disabled
sort_6 = SortList(Keys=pdecon_14.XComponent, ValuesA=selected_curves)  # -> Keys, ValuesA; disabled
crv_sorted_by_x = Curve(sort_6.ValuesA)  # disabled
item_4 = ListItem(List=sort_6.ValuesA, Index=number_slider, Wrap=True)  # disabled
midpt_2 = CurveMiddle(Curve=crv_sorted_by_x)  # disabled
points = PointList(Points=midpt_2, Size=50)  # disabled
python_3 = GhPythonScript(iPtsList=midpt_2)  # -> out, simplify(distances); inputs iPtsList: list of Point3d; disabled
# ---------- python_3: Python ----------
import Rhino.Geometry as rg
import ghpythonlib.treehelpers as th

#rg.Point3d.DistanceTo(point3d)

distanceTree = [[]]
for i in range(0, len(iPtsList)-1):
    distanceList = []
    pointA = iPtsList[i]
    pointB = iPtsList[i+1]
    #pointC = iPtsList[i-1]
    distAB = pointA.DistanceTo(pointB)
    #distAC = pointA.DistanceTo(pointC)
    distanceList.append(i)
    distanceList.append(distAB)
    #distanceList.append(distAC)
    distanceTree.append(distanceList)


distances = th.list_to_tree(distanceTree)
# ---------- end python_3 ----------
clean_2 = CleanTree(RemoveNulls=True, RemoveInvalid=True, RemoveEmpty=True, Tree=python_3.distances)  # disabled
number_slider_2 = Slider(377, range=0..1000)  # disabled
itoleranceb = Slider(409, range=0..1000)  # disabled
python_4 = GhPythonScript(x=clean_2, iToleranceA=number_slider_2, iToleranceB=itoleranceb)  # -> out, crvToRemove; inputs x: tree; disabled
# ---------- python_4: Python ----------
import Rhino.Geometry as rg
import ghpythonlib.treehelpers as th

print x.BranchCount
print x.Branch(1)

crvIndexToRemove = []
for i in range(0, x.BranchCount-1):
    Di_Di1 = x.Branch(i)[1]
    Di1_Di2 = x.Branch(i+1)[1]
    if Di_Di1<iToleranceA:
        crvIndex = x.Branch(i)[0]+1
    if Di_Di1 > iToleranceA and Di_Di1+Di1_Di2 < iToleranceB:
        crvIndex = x.Branch(i)[0]+3
    if Di_Di1 > iToleranceA and Di_Di1+Di1_Di2 > iToleranceB:
        continue
    print crvIndex
    crvIndexToRemove.append(crvIndex)

crvToRemove = crvIndexToRemove
# ---------- end python_4 ----------
cull_i = CullIndex(List=crv_sorted_by_x, Indices=python_4.crvToRemove, Wrap=True)  # disabled
selected_vertical_stress_curves = Curve(cull_i)  # disabled

end_4 = EndPoints(Curve=crv_re_aligned_olong_y)  # -> Start, End
pt_6 = Point(end_4.Start)

# ----
# old geo from karamba: 97-727
# new geo from rhino vault (bill): 69-232
itoleranceb_2 = Slider(224, range=0..1000)

convert_to_meters = Panel("1000")
division = Division(A=itoleranceb_2, B=convert_to_meters)
division_2 = Division(A=Slider(140, range=0..1000), B=convert_to_meters)

# ----
# 1. clean up the stress curves (longitudinal):
# c. delete the stress lines that are too
# close to its neighboring curves (including the duplicate ones)
midpt_3 = CurveMiddle(Curve=crv_re_aligned_olong_y)
pdecon_15 = Deconstruct(Point=midpt_3)  # -> XComponent, YComponent, ZComponent
sort_7 = SortList(Keys=pdecon_15.YComponent, ValuesA=crv_re_aligned_olong_y, ValuesB=midpt_3)  # -> Keys, ValuesA, ValuesB
points_2 = PointList(Points=sort_7.ValuesB, Size=0.05)
python_5 = GhPythonScript(iPtsList=sort_7.ValuesB)  # -> out, simplify(distances); inputs iPtsList: list of Point3d
# ---------- python_5: Python ----------
import Rhino.Geometry as rg
import ghpythonlib.treehelpers as th

#rg.Point3d.DistanceTo(point3d)

distanceTree = [[]]
for i in range(0, len(iPtsList)-1):
    distanceList = []
    pointA = iPtsList[i]
    pointB = iPtsList[i+1]
    #pointC = iPtsList[i-1]
    distAB = pointA.DistanceTo(pointB)
    #distAC = pointA.DistanceTo(pointC)
    distanceList.append(i)
    distanceList.append(distAB)
    #distanceList.append(distAC)
    distanceTree.append(distanceList)

# remove any empty sublist
def clean_nested(l):
    cleaned = []
    for v in l:
        if isinstance(v, list):
            v = clean_nested(v)
            if not v:
                continue
        cleaned.append(v)
    return cleaned
    
distances = th.list_to_tree(clean_nested(distanceTree))
# ---------- end python_5 ----------
crv = Curve(sort_7.ValuesA)
python_6 = GhPythonScript(x=python_5.distances, iToleranceA=division_2, iToleranceB=division)  # -> out, crvToRemove; inputs x: tree
# ---------- python_6: Python ----------
import Rhino.Geometry as rg
import ghpythonlib.treehelpers as th

print x.BranchCount
print x.Branch(1)

crvIndexTree = [[]]
crvIndexToRemoveA = []
for i in range(0, x.BranchCount):
    Di_Di1 = x.Branch(i)[1]
#    Di1_Di2 = x.Branch(i+1)[1]
    if Di_Di1<iToleranceA:
        crvIndex = x.Branch(i)[0]
        #print i, Di_Di1
#    if Di_Di1 > iToleranceA and Di_Di1+Di1_Di2 < iToleranceB:
#        crvIndex = x.Branch(i)[0]+1
#    if Di_Di1 > iToleranceA and Di_Di1+Di1_Di2 > iToleranceB:
#        continue
#    #print crvIndex
        crvIndexToRemoveA.append(crvIndex)
print crvIndexToRemoveA


crvIndexToRemoveB = []
for i in range(0, x.BranchCount-1):
    Di_Di1 = x.Branch(i)[1]
    Di1_Di2 = x.Branch(i+1)[1]
    dist = Di_Di1 + Di1_Di2
    #print i, dist
#    if Di_Di1<iToleranceA:
#        crvIndex = x.Branch(i)[0]
#        print i, Di_Di1
    if Di_Di1+Di1_Di2 < iToleranceB:
        crvIndex = x.Branch(i)[0]
        crvIndexToRemoveB.append(crvIndex)
        print i, dist, "true"
#    if Di_Di1 >= iToleranceA and Di_Di1+Di1_Di2 > iToleranceB:
#        continue
print crvIndexToRemoveB
    

crvIndexTree.append(crvIndexToRemoveA)
crvIndexTree.append(crvIndexToRemoveB)

#flatten the nested list
crvIndexList = [j for i in crvIndexTree for j in i]

crvToRemove = list(set(crvIndexList))
# ---------- end python_6 ----------
cull_i_2 = CullIndex(List=crv, Indices=expr("x+1", python_6.crvToRemove), Wrap=True)

pt_7 = Point(sort_7.ValuesB)
panel_7 = Panel(python_5.distances)
# 这里有问题，因该是recursivly remove
division_3 = Division(A=Slider(195, range=0..1000), B=convert_to_meters)
python_7 = GhPythonScript(x=python_5.distances, iToleranceB=division_3)  # -> out, crvToRemove; inputs x: tree
# ---------- python_7: Python ----------
import Rhino.Geometry as rg
import ghpythonlib.treehelpers as th

print x.BranchCount
print x.Branch(1)

crvIndexTree = [[]]
#crvIndexToRemoveA = []
#for i in range(0, x.BranchCount):
#    Di_Di1 = x.Branch(i)[1]
##    Di1_Di2 = x.Branch(i+1)[1]
#    if Di_Di1<iToleranceA:
#        crvIndex = x.Branch(i)[0]
#        #print i, Di_Di1
##    if Di_Di1 > iToleranceA and Di_Di1+Di1_Di2 < iToleranceB:
##        crvIndex = x.Branch(i)[0]+1
##    if Di_Di1 > iToleranceA and Di_Di1+Di1_Di2 > iToleranceB:
##        continue
##    #print crvIndex
#        crvIndexToRemoveA.append(crvIndex)
#print crvIndexToRemoveA


crvIndexToRemoveB = []
for i in range(0, x.BranchCount-1):
    Di_Di1 = x.Branch(i)[1]
    Di1_Di2 = x.Branch(i+1)[1]
    dist = Di_Di1 + Di1_Di2
    #print i, dist
#    if Di_Di1<iToleranceA:
#        crvIndex = x.Branch(i)[0]
#        print i, Di_Di1
    if Di_Di1+Di1_Di2 < iToleranceB:
        crvIndex = x.Branch(i)[0]
        crvIndexToRemoveB.append(crvIndex)
        print i, dist, "true"
#    if Di_Di1 >= iToleranceA and Di_Di1+Di1_Di2 > iToleranceB:
#        continue
print crvIndexToRemoveB
    

#crvIndexTree.append(crvIndexToRemoveA)
crvIndexTree.append(crvIndexToRemoveB)

#flatten the nested list
crvIndexList = [j for i in crvIndexTree for j in i]

crvToRemove = list(set(crvIndexList))
# ---------- end python_7 ----------
cull_i_3 = CullIndex(List=crv, Indices=expr("x+1", python_7.crvToRemove), Wrap=True)

# ----
# 0. Deconstruct the global geo mesh to get:
# b) the central curve for mirroring
midpt_4 = CurveMiddle(Curve=bottom_edge_short)
midpt_5 = CurveMiddle(Curve=bottom_edge_long)
ln = Line(StartPoint=midpt_5, EndPoint=midpt_4)
len_2 = Length(Curve=ln)
number_slider_3 = Slider(100, range=0..500)
division_4 = Division(A=len_2, B=Slider(0.1, range=0..1))
divide = DivideCurve(Curve=ln, Count=division_4, Kinks=False)  # -> Points, Tangents, Parameters
Z = UnitZ(Factor=1)
project_pts = ProjectPtsToMesh(Points=divide.Points, TargetMesh=mesh_4, Direction=Z)  # -> simplify(ProjectedPoints)
intcrv_5 = Interpolate(Vertices=project_pts, Degree=3, Periodic=False, KnotStyle=1)  # -> Curve, Length, Domain
central_curve_on_mesh = Curve(intcrv_5.Curve)

# ----
# Solver
run = BooleanToggle(True)
iterations = Panel("10000")

convert_to_meters_2 = Panel("1000")
convert_to_meters_3 = Panel("1000")

list = ValueList({"First": 0, "Last": -1}, selected="First")  # disabled
list_2 = ValueList({"First": 0, "Last": -1}, selected="Last")  # disabled

panel_8 = Panel("""-1
0""")

number_slider_4 = Slider(1.2, range=0..1.2)
maxlength = Slider(1.18, range=0..1.2)

crv_2 = Curve([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])

# ----
# use the discretised surfaces
points_3 = PointList(Points=pt, Size=0.15)
panel_9 = Panel(discretised_panel_crvs)
crv_3 = Curve(flatten(discretised_panel_crvs))
graft = GraftTree(Tree=crv_3, IncludeEmptyLists=True, IncludeNullItems=True)  # -> simplify(Tree)
item_5 = ListItem(List=crv_3, Index=Slider(77, range=0..100), Wrap=True)
explode = Explode(Curve=graft, Recursive=True)  # -> simplify(Segments), simplify(Vertices)
panel_10 = Panel("""{0}
{11}""")
crv_4 = Curve(explode.Segments)
pt_8 = Point(simplify(flatten(explode.Vertices)))
branch = TreeBranch(Tree=pt, Path=panel_10, MaintainPaths=True)
cullpt = CullDuplicates(Points=pt_8, Tolerance=0.1, CullMode=3)  # -> Points, Indices, Valence
midpt_6 = CurveMiddle(Curve=crv_3)
duppt = RemoveDuplicatePts(Points=pt_8, Tolerance=0.01)
item_6 = ListItem(List=pt, Index=0, Wrap=True)  # -> Item1, Item, Item1_2, Item2
points_4 = PointList(Points=midpt_6, Size=0.07)
points_5 = PointList(Points=duppt, Size=0.03)
merge_5 = Merge(Data1=item_6.Item, Data2=item_6.Item1, Data3=branch)  # -> flatten(Result)
pdecon_16 = Deconstruct(Point=duppt)  # -> XComponent, YComponent, ZComponent
duppt_2 = RemoveDuplicatePts(Points=flatten(merge_5), Tolerance=0.01)
equals = Equality(FirstNumber=pdecon_16.ZComponent, SecondNumber=0)  # -> Equality, Inequality
mindex = MemberIndex(Set=duppt, Member=explode.Vertices)  # -> simplify(Index), Count
python_8 = GhPythonScript(iPts=duppt, iLines=explode.Vertices)  # -> out, simplify(iPL); inputs iPts: list of Point3d, iLines: tree of Point3d
# ---------- python_8: Python ----------
import Rhino.Geometry as rg
import ghpythonlib.treehelpers as th

print iLines.BranchCount

indexTree = [[]]
for i in range(0, len(iPts)):
    pointToSearch = iPts[i]
    indexList = []
    for j in range(0, iLines.BranchCount):
        for t in range(0, len(iLines.Branch(j))):
            pointToCompare = iLines.Branch(j)[t]
            dist = pointToSearch.DistanceTo(pointToCompare)
            if dist == 0:
                indexList.append(j)

    indexTree.append(list(set(indexList)))

#remove empty sublist
# list(filter(None, indexTree))


iPL = th.list_to_tree(list(filter(None, indexTree)))
# ---------- end python_8 ----------
path_mapper = PathMapper(mindex.Index, source="{a; b}", target="{a}")
dispatch_8 = Dispatch(List=duppt, DispatchPattern=equals.Equality)  # -> ListA, ListB
cps = ClosestPoints(Point=duppt_2, Cloud=duppt, Count=1)  # -> flatten(ClosestPoint), CPIndex, Distance
point_indices_for_each_polyline = Panel(path_mapper)
polyline_indices_for_each_point = Panel(python_8.iPL)

pts_on_the_edge_curves = Point(cps.ClosestPoint)

mindex_2 = MemberIndex(Set=duppt, Member=pts_on_the_edge_curves)  # -> flatten(Index), Count
cull_i_4 = CullIndex(List=duppt, Indices=mindex_2.Index, Wrap=True)

pts_not_on_the_edge_curves = Point(cull_i_4)

point_indices_for_each_polyline_2 = Number(path_mapper)
polyline_indices_for_each_point_2 = Number(python_8.iPL)

pts_not_on_ground_2 = Point(dispatch_8.ListB)
# INPUT
pts_on_ground = Point(dispatch_8.ListA)

P = Positions(simplify(graft(pts_on_ground)))
mindex_3 = MemberIndex(Set=duppt, Member=pts_on_ground)  # -> Index, Count
mindex_4 = MemberIndex(Set=duppt, Member=pts_not_on_ground_2)  # -> Index, Count
P_2 = Positions(simplify(graft(pts_not_on_ground_2)))
path = ConstructPath(Indices=mindex_3.Index)  # -> simplify(Branch)
path_2 = ConstructPath(Indices=mindex_4.Index)  # -> simplify(Branch)
tstat = TreeStatistics(Tree=P_2)  # -> Paths, Length, Count
tstat_2 = TreeStatistics(Tree=P)  # -> Paths, Length, Count
replace = ReplacePaths(Data=P_2, Search=tstat.Paths, Replace=flatten(path_2))
replace_2 = ReplacePaths(Data=P, Search=tstat_2.Paths, Replace=flatten(path))
pts_not_on_ground_3 = Geometry(replace)
pts_on_ground_2 = Geometry(replace_2)

# ---- group: Planarize Behaviour
ilp = ILP(point_indices_for_each_polyline_2)
# BEHAVIOURS
ipl = IPL(polyline_indices_for_each_point_2)
c_script = CSharpScript(
    iPL=ipl,
    iLP=ilp,
    iF=Slider(0.3, range=0..1),
    Reference="C:\USERS\SIENNASUN513\APPDATA\ROAMING\MCNEEL\RHINOCEROS\PACKAGES\7.0\ABXM_CORE\1.4.0\ABxM.Core.dll")  # -> out, oBehavior; inputs iPL: tree of Int32, iLP: tree of Int32, iF: Double
# ---------- c_script: C# usings ----------
using ABxM.Core;
using ABxM.Core.Agent;
using ABxM.Core.AgentSystem;
using ABxM.Core.Behavior;
using ABxM.Core.Environments;
# ---------- c_script: C# ----------
  behavior.PL = iPL; //polyline indices for each point
  behavior.LP = iLP; //point indices for each polyline
  behavior.Factor = iF;
  oBehavior = behavior;
# ---------- c_script: C# additional code ----------
PlanarizeBehavior behavior = new PlanarizeBehavior(1.0);

public class PlanarizeBehavior : BehaviorBase
{
  public DataTree<int> PL;
  public DataTree<int> LP;
  public double Factor = 1;

  public PlanarizeBehavior(double weight)
  {
    Weight = weight;
  }

  public override void Execute(AgentBase agent)
  {
    CartesianAgent cartesianAgent = agent as CartesianAgent;
    CartesianAgentSystem cartesianAgentSystem = cartesianAgent.AgentSystem as CartesianAgentSystem;
    //CartesianEnvironment cartesianEnvironment = cartesianAgentSystem.CartesianEnvironment;

    //======================================================================================================
    // Task: Compute the "move" vector caused by this behavior and add it to the list "cartesianAgent.Moves"
    //======================================================================================================

    // foreach polygon connect to agent, create fit plane through vert of polygon
    // get closest point of agent on plane
    // compute direction from agent to point on plane
    // add 3 directions to move list * scalar value (0.1)

    int agentID = cartesianAgent.Id;
    List<int> polylinesIndices = PL.Branch(agentID); // get the indices of polylines that the agent is adjacent to

    Vector3d moveVector = Vector3d.Zero;
    //moveVector = Vector3d.Zero;

    // now loop through all adjacent polylines
    foreach(int polyIndex in polylinesIndices)
    {
      List<int> vertexIndices = LP.Branch(polyIndex);

      List<Point3d> vertexPoints = new List<Point3d>();
      for(int i = 0; i < vertexIndices.Count - 1; i++)
        //foreach(int vertIndex in vertexIndices)
      {
        int vertIndex = vertexIndices[i];
        CartesianAgent cartAgent = (CartesianAgent) cartesianAgentSystem.Agents[vertIndex];
        vertexPoints.Add(cartAgent.Position);
      }
      Plane fitplane;
      var dummyPlane = Plane.FitPlaneToPoints(vertexPoints, out fitplane);
      Point3d targetPoint = fitplane.ClosestPoint(cartesianAgent.Position);
      Vector3d targetVector = targetPoint - cartesianAgent.Position;

      moveVector += targetVector;
    }
    moveVector /= polylinesIndices.Count;
    moveVector *= this.Factor;

    cartesianAgent.Moves.Add(moveVector);
    cartesianAgent.Weights.Add(1.0);
  }
}
# ---------- end c_script ----------

# ----
P_3 = Positions(pts_on_ground_2)
P_4 = Positions(pts_not_on_ground_3)

# ----
# AGENTS
cartesian_agent = DefineCartesianAgent(Positions=P_3)
cartesian_agent_2 = DefineCartesianAgent(Positions=P_4, Behaviors=c_script.oBehavior)
merge_6 = Merge(Data1=cartesian_agent, Data2=cartesian_agent_2)  # -> flatten(Result)

# ----
# ENVIRONMENT
pdecon_17 = Deconstruct(Point=pts_on_ground)  # -> XComponent, YComponent, ZComponent
boundary_corners = Point(pts_on_the_edge_curves)
sort_8 = SortList(Keys=pdecon_17.XComponent, ValuesA=pts_on_ground)  # -> Keys, ValuesA
P_5 = Positions(simplify(graft(boundary_corners)))
mindex_5 = MemberIndex(Set=duppt, Member=boundary_corners)  # -> Index, Count
subset = SubList(List=sort_8.ValuesA, Domain="0 to 14", Wrap=True)  # -> List, Index
subset_2 = SubList(List=sort_8.ValuesA, Domain="15 to 25", Wrap=True)  # -> List, Index
tstat_3 = TreeStatistics(Tree=P_5)  # -> Paths, Length, Count
pdecon_18 = Deconstruct(Point=subset.List)  # -> XComponent, YComponent, ZComponent
pdecon_19 = Deconstruct(Point=subset_2.List)  # -> XComponent, YComponent, ZComponent
path_3 = ConstructPath(Indices=mindex_5.Index)  # -> simplify(Branch)
sort_9 = SortList(Keys=pdecon_18.YComponent, ValuesA=subset.List)  # -> Keys, ValuesA
sort_10 = SortList(Keys=pdecon_19.YComponent, ValuesA=subset_2.List)  # -> Keys, ValuesA
replace_3 = ReplacePaths(Data=P_5, Search=tstat_3.Paths, Replace=flatten(path_3))
item_7 = ListItem(List=sort_9.ValuesA, Index=0, Wrap=True)  # -> Item1, Item
item_8 = ListItem(List=sort_10.ValuesA, Index=0, Wrap=True)  # -> Item1, Item
merge_7 = Merge(Data1=item_7.Item1, Data2=item_7.Item, Data3=item_8.Item1, Data4=item_8.Item)
boundary_corners_2 = Point(merge_7)
boundary_points = Geometry(replace_3)

# ----
# CartesianEnvironment
c_script_2 = CSharpScript(
    iBoundaryCorners=boundary_points,
    Reference="C:\USERS\SIENNASUN513\APPDATA\ROAMING\MCNEEL\RHINOCEROS\PACKAGES\7.0\ABXM_CORE\1.4.0\ABxM.Core.dll")  # -> out, oEnvironment; inputs iBoundaryCorners: list of Point3d
# ---------- c_script_2: C# usings ----------
using System.IO;
using System.Linq;
using System.Data;
using System.Drawing;
using System.Reflection;
using System.Windows.Forms;
using System.Xml;
using System.Xml.Linq;
using System.Runtime.InteropServices;

using Rhino.DocObjects;
using Rhino.Collections;
using GH_IO;
using GH_IO.Serialization;
using ABxM.Core;
using ABxM.Core.Utilities;
using ABxM.Core.Environments;
using ABxM.Core.Behavior;
using ABxM.Core.Agent;
using ABxM.Core.AgentSystem;
# ---------- c_script_2: C# ----------
    oEnvironment = new CartesianEnvironment(iBoundaryCorners);
# ---------- end c_script_2 ----------

E = CartesianEnvironment(c_script_2.oEnvironment)
# AGENT SYSTEM
cartesian_sys = DefineCartesianAgentSystem(CartesianAgents=merge_6, ComputeDiagram=0)

solver_silent = SilentSolver(Execute=run, AgentSystems=cartesian_sys, MaxIterationCount=iterations)  # -> DisplayGeometries, AllAgentSystems, IterationCount

ticks = Panel(solver_silent.IterationCount)

point_network = Number(ilp)
c_script_3 = CSharpScript(
    iAS=solver_silent.AllAgentSystems,
    Reference="C:\Users\siennasun513\AppData\Roaming\McNeel\Rhinoceros\packages\7.0\ABxM_Core\1.4.0\ABxM.Core.dll")  # -> out, oGeo
# ---------- c_script_3: C# ----------
    CartesianAgentSystem mySystem = iAS as CartesianAgentSystem;
    List<Point3d> agentPos = new List<Point3d>();

    if (mySystem == null)
      return;

    List < CartesianAgent > agents = new List<CartesianAgent>();

    for (int i = 0; i < mySystem.Agents.Count; i++)
    {
      CartesianAgent agent = mySystem.Agents[i] as CartesianAgent;
      agentPos.Add(agent.Position);
    }


    oGeo = agentPos;
# ---------- end c_script_3 ----------
item_9 = ListItem(List=c_script_3.oGeo, Index=point_network, Wrap=True)
pline = PolyLine(Vertices=item_9, Closed=True)

boundary = BoundarySurfaces(Edges=pline)

prune = PruneTree(Tree=boundary, Minimum=1, Maximum=0)
planar = IsPlanar(Surface=prune, Interior=True)  # -> Planar, Plane
panel_11 = Panel(planar.Planar)

# ----
# 1. clean up the stress curves (longitudinal):
# d. select half of the stress curves and mirror
# the other half onto the mesh
longitudinal_stress_lines = Curve(cull_i_2)
mesh_center_pt_2 = Point(mesh_center_pt)
midpt_7 = CurveMiddle(Curve=longitudinal_stress_lines)
pdecon_20 = Deconstruct(Point=mesh_center_pt_2)  # -> XComponent, YComponent, ZComponent
pdecon_21 = Deconstruct(Point=midpt_7)  # -> XComponent, YComponent, ZComponent
smaller_6 = SmallerThan(FirstNumber=pdecon_21.YComponent, SecondNumber=pdecon_20.YComponent)  # -> SmallerThan, OrEqualTo
dispatch_9 = Dispatch(List=longitudinal_stress_lines, DispatchPattern=smaller_6.SmallerThan)  # -> ListA, ListB
list_3 = ValueList({"Left Boundary Edge": 0, "Right Boundary Edge": 1}, selected="Left Boundary Edge")
crv_to_mirror = Curve(dispatch_9.ListA)
crv_to_mirror_2 = Curve(dispatch_9.ListB)
central_curve_on_mesh_2 = Curve(central_curve_on_mesh)
filter = StreamFilter(Gate=list_3, Stream0=above_ground_edge_1, Stream1=above_ground_edge_2)
filter_2 = StreamFilter(Gate=list_3, Stream0=crv_to_mirror, Stream1=crv_to_mirror_2)
midpt_8 = CurveMiddle(Curve=filter_2)
midpt_9 = CurveMiddle(Curve=central_curve_on_mesh_2)
dist = Distance(PointA=midpt_8, PointB=midpt_9)
sort_11 = SortList(Keys=dist, ValuesA=midpt_8, ValuesB=filter_2)  # -> Keys, ValuesA, ValuesB
convert_to_meters_4 = Panel("1000")
division_5 = Division(A=Slider(53, range=0..1000), B=convert_to_meters_4)
smaller_7 = SmallerThan(FirstNumber=sort_11.Keys, SecondNumber=division_5)  # -> SmallerThan, OrEqualTo
dispatch_10 = Dispatch(List=sort_11.ValuesB, DispatchPattern=smaller_7.SmallerThan)  # -> ListA, ListB
crv_to_mirror_3 = Curve(dispatch_10.ListB)
crv_5 = Curve(dispatch_10.ListA)
midpt_10 = CurveMiddle(Curve=crv_to_mirror_3)
crv_cp_2 = CurveClosestPoint(Point=midpt_10, Curve=filter)  # -> Point, Parameter, Distance
dist_2 = Distance(PointA=graft(crv_cp_2.Point), PointB=graft(midpt_10))  # -> flatten(Distance)
Z_2 = UnitZ(Factor="-100")
extr = Extrude(Base=central_curve_on_mesh_2, Direction=Z_2)

division_6 = Division(A=Slider(245, range=0..1000), B=convert_to_meters_2)

larger_3 = LargerThan(FirstNumber=dist_2, SecondNumber=division_6)  # -> LargerThan, OrEqualTo
cull_2 = CullPattern(List=crv_to_mirror_3, CullPattern=larger_3.LargerThan)
final_selected_crv_to_mirror = Curve(cull_2)
mirror = Mirror(Geometry=final_selected_crv_to_mirror, Plane=extr)  # -> reverse(Geometry), Transform
merge_8 = Merge(Data1=mirror.Geometry, Data2=final_selected_crv_to_mirror)
mirrored_longitudinal_stress_curves = Curve(merge_8)

# ----
# 2. get the corresponding curves on the mesh
# a) find the closest point on mesh of these stress curves,
# interpolating the points on mesh to ensure the stress curves to be on the mesh
length_of_discretised_panel_in_vertical = Slider(250, range=10..1000)  # "length of discretised panel in vertical dir"
mesh_5 = Mesh(mesh)
len_3 = Length(Curve=mirrored_longitudinal_stress_curves)
tri = Triangulate(Mesh=mesh_5)  # -> Mesh, Count
panel_12 = Panel("""true
false
false
false""")  # disabled

qrmesh = QuadRemesh(Mesh=tri.Mesh, Settings={aqc=True, as=50, dhe=True, gci=0, null=False, pme=0, sa=0, tqc=2000})
division_7 = Division(A=length_of_discretised_panel_in_vertical, B=convert_to_meters_3)
medges = MeshEdges(Mesh=qrmesh)  # -> NakedEdges, InteriorEdges, NonManifoldEdges

division_8 = Division(A=len_3, B=division_7)
divide_2 = DivideCurve(Curve=mirrored_longitudinal_stress_curves, Count=division_8, Kinks=False)  # -> Points, Tangents, Parameters
divide_3 = DivideCurve(Curve=selected_vertical_stress_curves, Count=division_8, Kinks=False)  # -> Points, Tangents, Parameters; disabled
meshcp = MeshClosestPoint(Point=divide_2.Points, Mesh=tri.Mesh)  # -> Point, Index, simplify(Parameter)
meshcp_2 = MeshClosestPoint(Point=divide_3.Points, Mesh=tri.Mesh)  # -> Point, Index, Parameter; disabled
meval = MeshEval(Mesh=tri.Mesh, Parameter=meshcp_2.Parameter)  # -> Point, Normal, Colour; disabled
intcrv_6 = Interpolate(Vertices=meval.Point, Degree=3, Periodic=False, KnotStyle=0)  # -> Curve, Length, Domain; disabled
dispatch_11 = Dispatch(List=meshcp.Point, DispatchPattern=panel_12)  # -> ListA, ListB; disabled
reconstructed_vertical_stress_lines_on_m = Curve(intcrv_6.Curve)  # "reconstructed vertical stress lines on mesh"; disabled
geo_2 = Geometry(dispatch_11.ListA)  # disabled
flip_3 = FlipMatrix(Data=geo_2)  # disabled
intcrv_7 = Interpolate(Vertices=flip_3, Degree=3, Periodic=False, KnotStyle=1)  # -> Curve, Length, Domain; disabled
reconstructed_vertical_stress_lines_on_m_2 = Curve(graft(intcrv_7.Curve))  # "reconstructed vertical stress lines on mesh"; disabled

# ----
# need to triangulate the mesh in
# order to have mesh eval to work
meval_2 = MeshEval(Mesh=tri.Mesh, Parameter=meshcp.Parameter)  # -> simplify(Point), Normal, Colour

intcrv_8 = Interpolate(Vertices=meval_2.Point, Degree=3, Periodic=False, KnotStyle=1)  # -> Curve, Length, Domain
reconstructed_longitudinal_stress_lines = Curve(intcrv_8.Curve)  # "reconstructed longitudinal stress lines on mesh"

# ----
# 2. get the corresponding curves on the mesh
# b) find the closest points on the mesh's 4 naked boundaries
# of the end points of the stress curves, interpolating the points again
# to ensure the stress curves to be intersecting with the mesh's boundary edges
above_ground_edge_2_2 = Curve(intcrv_4.Curve)
above_ground_edge_1_2 = Curve(intcrv_2.Curve)
bottom_edge_short_2 = Curve(intcrv_3.Curve)
bottom_edge_long_2 = Curve(bottom_edge_long)
cccp = CurveCurveClosestPoint(CurveA=reconstructed_vertical_stress_lines_on_m_2, CurveB=above_ground_edge_1_2)  # -> PointOnA, ParamOnA, PointOnB, ParamOnB; disabled
cccp_2 = CurveCurveClosestPoint(CurveA=reconstructed_longitudinal_stress_lines, CurveB=bottom_edge_short_2)  # -> PointOnA, ParamOnA, PointOnB, ParamOnB
cccp_3 = CurveCurveClosestPoint(CurveA=reconstructed_vertical_stress_lines_on_m_2, CurveB=above_ground_edge_2_2)  # -> PointOnA, ParamOnA, PointOnB, ParamOnB; disabled
cccp_4 = CurveCurveClosestPoint(CurveA=reconstructed_longitudinal_stress_lines, CurveB=bottom_edge_long_2)  # -> PointOnA, ParamOnA, PointOnB, ParamOnB
pt_9 = Point(cccp.PointOnB)  # disabled
pt_10 = Point(cccp_3.PointOnB)  # disabled
pt_11 = Point(cccp_2.PointOnB)
pt_12 = Point(cccp_4.PointOnB)
ins_5 = InsertItems(List=meshcp.Point, Item=pt_12, Indices=0, Wrap=True)  # -> simplify(List)
ins_6 = InsertItems(List=flip_3, Item=pt_10, Indices=list_2, Wrap=True)  # -> simplify(List); disabled
ins_7 = InsertItems(List=ins_5, Item=pt_11, Indices=-1, Wrap=True)  # -> simplify(List)
ins_8 = InsertItems(List=ins_6, Item=pt_9, Indices=list, Wrap=True)  # -> simplify(List); disabled
intcrv_9 = Interpolate(Vertices=ins_8, Degree=3, Periodic=False, KnotStyle=1)  # -> Curve, Length, Domain; disabled
intcrv_10 = Interpolate(Vertices=ins_7, Degree=3, Periodic=False, KnotStyle=0)  # -> Curve, Length, Domain
reconstructed_longitudinal_stress_lines_2 = Curve(flatten(intcrv_10.Curve))  # "reconstructed longitudinal stress lines on mesh"
reconstructed_longitudinal_stress_lines_3 = Curve(intcrv_9.Curve)  # "reconstructed longitudinal stress lines on mesh"; disabled
midpt_11 = CurveMiddle(Curve=reconstructed_longitudinal_stress_lines_2)
pdecon_22 = Deconstruct(Point=midpt_11)  # -> XComponent, YComponent, ZComponent
sort_12 = SortList(Keys=pdecon_22.YComponent, ValuesA=reconstructed_longitudinal_stress_lines_2)  # -> Keys, ValuesA
ins_9 = InsertItems(List=flatten(reconstructed_longitudinal_stress_lines_3), Item=bottom_edge_long_2, Indices=0, Wrap=True)  # disabled
ins_10 = InsertItems(List=sort_12.ValuesA, Item=above_ground_edge_1_2, Indices=0, Wrap=True)
ins_11 = InsertItems(List=flatten(ins_9), Item=bottom_edge_short_2, Indices=-1, Wrap=True)  # disabled
ins_12 = InsertItems(List=ins_10, Item=above_ground_edge_2_2, Indices=-1, Wrap=True)
longitudinal_crvs_including_mesh_edge = Curve(ins_12)
vertical_crvs_including_mesh_edge = Curve(ins_11)  # disabled

# ----
# 3. Find Intersecting Pts on Mesh
# a) divide the longitudinal curves
# to generate vertical curves
longitudinal_crvs_including_mesh_edge_2 = Curve(longitudinal_crvs_including_mesh_edge)
length_of_the_panel = Slider(0.95, range=0.2..1.2)
len_4 = Length(Curve=longitudinal_crvs_including_mesh_edge_2)
division_9 = Division(A=len_4, B=length_of_the_panel)
avr_2 = Average(Input=division_9)
divide_4 = DivideCurve(Curve=longitudinal_crvs_including_mesh_edge_2, Count=avr_2, Kinks=False)  # -> simplify(Points), Tangents, Parameters

# ----
# 3. Find Intersecting Pts on Mesh
# a) offset these pts to find the offset long fiber curves and the offset vertical curves
# (this is to ensure long fiber not to be printed on the connecting edges)
flip_4 = FlipMatrix(Data=divide_4.Points)
python_9 = GhPythonScript(iPts=divide_4.Points)  # -> out, midPts; inputs iPts: tree of Point3d
# ---------- python_9: Python ----------
import Rhino.Geometry as rg
import ghpythonlib.treehelpers as th

print iPts.BranchCount
print iPts.Branch(0)

midPointTree = [[]]
for i in range (0, iPts.BranchCount-1):
    midPointList = []
    for j in range(0, len(iPts.Branch(i))):
        pointA = iPts.Branch(i)[j]
        pointB = iPts.Branch(i+1)[j]
        pointC = (pointA+pointB)*0.5
        midPointList.append(pointC)
    midPointTree.append(midPointList)
    
# remove any empty sublist
def clean_nested(l):
    cleaned = []
    for v in l:
        if isinstance(v, list):
            v = clean_nested(v)
            if not v:
                continue
        cleaned.append(v)
    return cleaned

cleanedTree = clean_nested(midPointTree)

midPts = th.list_to_tree(cleanedTree)
# ---------- end python_9 ----------
python_10 = GhPythonScript(iPts=flip_4)  # -> out, midPts; inputs iPts: tree of Point3d; same code as python_9
offset_pts_on_long_fiber_crvs = Point(python_9.midPts)
offset_pts_on_vertical_crvs = Point(python_10.midPts)
mesh_6 = Mesh(tri.Mesh)
meshcp_3 = MeshClosestPoint(Point=offset_pts_on_vertical_crvs, Mesh=mesh_6)  # -> Point, Index, Parameter
meshcp_4 = MeshClosestPoint(Point=offset_pts_on_long_fiber_crvs, Mesh=mesh_6)  # -> Point, Index, Parameter

nurbs_3 = NurbsCurve(Vertices=flip_4, Degree=3, Periodic=False)  # -> Curve, Length, Domain
cull_i_5 = CullIndex(List=flatten(nurbs_3.Curve), Indices=panel_8, Wrap=True)
panel_13 = Panel(meshcp_3.Point)

meval_3 = MeshEval(Mesh=mesh_6, Parameter=meshcp_4.Parameter)  # -> Point, Normal, Colour
meval_4 = MeshEval(Mesh=mesh_6, Parameter=meshcp_3.Parameter)  # -> Point, Normal, Colour

intcrv_11 = Interpolate(Vertices=meval_4.Point, Degree=3, Periodic=False, KnotStyle=0)  # -> Curve, Length, Domain
intcrv_12 = Interpolate(Vertices=meval_3.Point, Degree=3, Periodic=False, KnotStyle=1)  # -> Curve, Length, Domain

offset_verticall_crvs = Curve(cull_i_5)
offset_horizontal_crvs = Curve(intcrv_12.Curve)
offset_vertical_crvs = Curve(intcrv_11.Curve)

# ----
# 3. Find Intersecting Pts on Mesh
# c) find the intersecting pts of the offset long
#  fiber curves and the offset vertical curves
python_11 = GhPythonScript(x=flatten(offset_verticall_crvs), y=flatten(offset_horizontal_crvs))  # -> out, intersection; inputs x: list of Curve, y: list of Curve
# ---------- python_11: Python ----------
import Rhino.Geometry as rg
import ghpythonlib.treehelpers as th

intersectingPts = [[]]
for i in range(0, len(x)):
    intersectPts = []
    for j in range(0, len(y)):
        events = rg.Intersect.Intersection.CurveCurve(x[i], y[j], 100.0, 50.0)
#        rg.Intersect.Intersection.CurveCurve()
        #print type(events)
        #print type(events[0])
        #print events.Count
        if events.Count > 0:
            pts = events[0].PointA
            #print pts
            intersectPts.append(pts)
    intersectingPts.append(intersectPts)
    print intersectingPts


# remove any empty sublist
def clean_nested(l):
    cleaned = []
    for v in l:
        if isinstance(v, list):
            v = clean_nested(v)
            if not v:
                continue
        cleaned.append(v)
    return cleaned

cleanedTree = clean_nested(intersectingPts)


intersection = th.list_to_tree(cleanedTree)
# ---------- end python_11 ----------
intersecting_pts_on_mesh = Point(python_11.intersection)
flip_5 = FlipMatrix(Data=intersecting_pts_on_mesh)

# ----
# 4. Include the edges points to the intersecting pts list
# a) find the closest points on the 4 boundary edges of the mesh
# to the end points of these offset curves
# b) resort the order of the point list
bottom_edge_short_3 = Curve(bottom_edge_short)
bottom_edge_long_3 = Curve(bottom_edge_long)
above_ground_edge_1_3 = Curve(intcrv_2.Curve)
above_ground_edge_2_3 = Curve(intcrv_4.Curve)
ins_13 = InsertItems(List=flatten(offset_verticall_crvs), Item=bottom_edge_long_3, Indices=0, Wrap=True)
ins_14 = InsertItems(List=flatten(ins_13), Item=bottom_edge_short_3, Indices=-1, Wrap=True)  # -> simplify(graft(List))
end_5 = EndPoints(Curve=ins_14)  # -> Start, End
end_6 = EndPoints(Curve=offset_horizontal_crvs)  # -> Start, End
pt_13 = Point(end_6.Start)
pt_14 = Point(end_6.End)
pt_15 = Point(end_5.Start)
pt_16 = Point(end_5.End)
crv_cp_3 = CurveClosestPoint(Point=pt_13, Curve=bottom_edge_long_3)  # -> simplify(Point), Parameter, Distance
crv_cp_4 = CurveClosestPoint(Point=pt_14, Curve=bottom_edge_short_3)  # -> simplify(Point), Parameter, Distance
crv_cp_5 = CurveClosestPoint(Point=pt_15, Curve=above_ground_edge_1_3)  # -> simplify(Point), Parameter, Distance
crv_cp_6 = CurveClosestPoint(Point=pt_16, Curve=above_ground_edge_2_3)  # -> simplify(Point), Parameter, Distance
ins_15 = InsertItems(List=flip_5, Item=crv_cp_3.Point, Indices=0, Wrap=True)
ins_16 = InsertItems(List=ins_15, Item=crv_cp_4.Point, Indices=-1, Wrap=True)  # -> simplify(List)
flip_6 = FlipMatrix(Data=ins_16)
ins_17 = InsertItems(List=flip_6, Item=crv_cp_5.Point, Indices=0, Wrap=True)
ins_18 = InsertItems(List=ins_17, Item=crv_cp_6.Point, Indices=-1, Wrap=True)  # -> simplify(List)
points_6 = PointList(Points=ins_18, Size=0.15)

# ----
# 5. Discretisation the mesh
# a) generate the surface list
# based on the point list
python_12 = GhPythonScript(iPts=ins_18)  # -> out, simplify(pointTree), simplify(oSurface), oCurves; inputs iPts: tree of Point3d
# ---------- python_12: Python ----------
import Rhino.Geometry as rg
import ghpythonlib.treehelpers as th

#print iPts.BranchCount
#print iPts.Branch(0)


pointTree =[[]]
surfaceTree = [[]]
curveTree = [[]]

print iPts.Branch(3)[6]
print iPts.Branch(4)[7]

for i in range(0, iPts.BranchCount-1):
    points=[]
    surfaces = []
    curves = []
    for j in range(0, len(iPts.Branch(i))-1):
        point = []
        pointforClosedCurve = []
        pointA = iPts.Branch(i)[j]
        pointB = iPts.Branch(i)[j+1]
        pointC = iPts.Branch(i+1)[j+1]
        pointD = iPts.Branch(i+1)[j]
        point.append(pointA)
        point.append(pointB)
        point.append(pointC)
        point.append(pointD)
        points.append(point)
        print i, j, pointC

        surface = rg.NurbsSurface.CreateFromCorners(pointA, pointB, pointC, pointD)
        surfaces.append(surface)
        
        pointforClosedCurve.append(pointA)
        pointforClosedCurve.append(pointB)
        pointforClosedCurve.append(pointC)
        pointforClosedCurve.append(pointD)
        pointforClosedCurve.append(pointA)
        curve = rg.Curve.CreateInterpolatedCurve(pointforClosedCurve, 1, 0)
        #closedCurve = rg.Curve.MakeClosed(curve, 0.10)
        #print closedCurve
        curves.append(curve)
        
        
        
    pointTree.append(points)
    surfaceTree.append(surfaces)
    curveTree.append(curves)

# remove any empty sublist
def clean_nested(l):
    cleaned = []
    for v in l:
        if isinstance(v, list):
            v = clean_nested(v)
            if not v:
                continue
        cleaned.append(v)
    return cleaned

cleanedPointTree = clean_nested(pointTree)
cleanedSurfaceTree = clean_nested(surfaceTree)
cleanedCurveTree = clean_nested(curveTree)

pointTree = th.list_to_tree(cleanedPointTree)
oSurface = th.list_to_tree(cleanedSurfaceTree)
oCurves = th.list_to_tree(cleanedCurveTree)
# ---------- end python_12 ----------
pt_17 = Point(python_12.pointTree)
srf = Surface(python_12.oSurface)

# ----
# 5. Discretisation the mesh
# b) compare the surface area: if the sum of any two adjacent surface area is
# less than 1 square meters, and the edge length after merging is less than 1200mm, then merge these surfaces
crv_6 = Curve(python_12.oCurves)
max_printable_length = Slider(1.2, range=1.19..1.2)
lenseg = SegmentLengths(Curve=crv_6)  # -> ShortestLength, ShortestDomain, LongestLength, LongestDomain
area_4 = Area(Geometry=srf)  # -> Area, Centroid
smaller_8 = SmallerThan(FirstNumber=lenseg.LongestLength, SecondNumber=max_printable_length)  # -> SmallerThan, OrEqualTo
smaller_9 = SmallerThan(FirstNumber=area_4.Area, SecondNumber=max_printable_length)  # -> SmallerThan, OrEqualTo
dispatch_12 = Dispatch(List=srf, DispatchPattern=smaller_9.SmallerThan)  # -> ListA, ListB
dispatch_13 = Dispatch(List=srf, DispatchPattern=smaller_8.SmallerThan)  # -> ListA, ListB
srf_can_be_considered_for_merging = Geometry(simplify(dispatch_13.ListA))
merge_9 = Merge(Data1=simplify(dispatch_13.ListB), Data2=simplify(dispatch_12.ListB))
srf_needs_to_be_split = Geometry(simplify(merge_9))
area_5 = Area(Geometry=srf_can_be_considered_for_merging)  # -> Area, Centroid
wires_2 = BrepWireframe(Brep=srf_can_be_considered_for_merging, Density=-1)
path_mapper_2 = PathMapper(wires_2, source="{A; B}", target="{A}")

lng = ListLength(List=wires_2)
item_10 = ListItem(List=flatten(lng), Index=0, Wrap=True)

# ----
# first time to find
# srfs to merge
python_13 = GhPythonScript(
    iAreas=area_5.Area,
    iSrfs=srf_can_be_considered_for_merging,
    iCrvs=path_mapper_2,
    maxArea=number_slider_4,
    maxLength=maxlength,
    listLength=item_10)  # -> out, simplify(oMergedSrf), simplify(oUnmergedSrf), simplify(oRemoveDuplicateBreps); inputs iAreas: tree, iSrfs: tree of Brep, iCrvs: tree of Curve, listLength: Int32
# ---------- python_13: Python ----------
import ghpythonlib.treehelpers as th
import Rhino.Geometry as rg
import math as math

print iAreas.BranchCount
print len(iAreas.Branch(8))
print iAreas.Branch(0)[0]
print len(iAreas.Branch(0))

adjacency8 = rg.Intersect.Intersection.BrepBrep(iSrfs.Branch(8)[0], iSrfs.Branch(8)[1], 0.01)
print adjacency8[0], len(adjacency8[1])

adjacency0 = rg.Intersect.Intersection.BrepBrep(iSrfs.Branch(0)[0], iSrfs.Branch(0)[1], 0.01)
print adjacency0[0], len(adjacency0[1])

#halfWayCounter = int(math.floor(len(iAreas.Branch(0))/2))
#print halfWayCounter

#when to check the mergeable surfaces the 1st time, the step count of the line index is 4
step = listLength
def to_Check(i, j):
    #bottom lines of brepCurrent and brepNext
    lineA = iCrvs.Branch(i)[j*step]
    lineB = iCrvs.Branch(i)[(j+1)*step]
    # top lines of brepCurrent and brepNext
    lineC = iCrvs.Branch(i)[j*step+2]
    lineD = iCrvs.Branch(i)[(j+1)*step+2]
    #calculate the length of the 2bottom lines
    lenBottom = lineA.GetLength()+lineB.GetLength()
    #calculate the length of the 2top lines
    lenTop = lineC.GetLength()+lineD.GetLength()
                        
    #get the area of these two adjacent srfs in square meters
    areaCurrent = iAreas.Branch(i)[j]
    areaNext = iAreas.Branch(i)[j+1]
    #print i, j, lenBottom, lenTop, areaCurrent+areaNext
    #check the sum of adancent lines are larger than 1200mm
    if areaCurrent+areaNext < maxArea and lenBottom < maxLength and lenTop < maxLength:
        return True, i, j, lenBottom, lenTop, areaCurrent+areaNext
    else:
        return False, i, j, lenBottom, lenTop, areaCurrent+areaNext

def to_Check_ReverseCount(i, j):
    lineA = iCrvs.Branch(i)[j*step]
    lineB = iCrvs.Branch(i)[(j-1)*step]
    # top lines of brepCurrent
    lineC = iCrvs.Branch(i)[j*step+2]
    lineD = iCrvs.Branch(i)[(j-1)*step+2]

    #calculate the length of the 4bottom lines
    lenBottom = lineA.GetLength()+lineB.GetLength()
    #calculate the length of the 4top lines
    lenTop = lineC.GetLength()+lineD.GetLength()
                        
    #get the area of these two adjacent srfs in square meters
    areaCurrent = iAreas.Branch(i)[j]
    areaNext = iAreas.Branch(i)[j-1]
    #print i, j, lenBottom, lenTop, areaCurrent+areaNext
    #check the sum of adancent lines are larger than 1200mm
    if areaCurrent+areaNext < maxArea and lenBottom < maxLength and lenTop < maxLength:
        return True, i, j, lenBottom, lenTop, areaCurrent+areaNext
    else:
        return False, i, j, lenBottom, lenTop, areaCurrent+areaNext

print to_Check(2, 0)
print to_Check_ReverseCount(2, 13)

mergedSrfTree = [[]]
unmergedSrfTree = [[]]


        
for i in range (0, iAreas.BranchCount):
    mergedSrfs = []
    unmergedSrfs = []
    #mergedSrfs.append(10)
    if len(iSrfs.Branch(i))==1:
        #unmergedSrfs.append(i)
        unmergedSrfs.append(iSrfs.Branch(i)[j])
    else:
        mergeSrf = []
        mergeSrf.append(i)
        halfWayCounter = int(math.floor(len(iAreas.Branch(i))/2))
        for j in range(0, halfWayCounter):
            if any(iSrfs.Branch(i)[j] in mergeSrf for mergeSrf in mergedSrfs)==False:
                #print i, j #print srfs not in the merged list
                if to_Check(i, j)[0]==True:
                    mergeSrf.append(iSrfs.Branch(i)[j])
                    mergeSrf.append(iSrfs.Branch(i)[j+1])
                    #mergedSrf = rg.Brep.MergeSurfaces(iSrfs.Branch(i)[j], iSrfs.Branch(i)[j+1], 0.1, 0.1)
                    mergedSrfs.append(mergeSrf)
                    print i, j
                else:
                    unmergedSrfs.append(iSrfs.Branch(i)[j])
            else:# if the existing srf is already in the merged srf list
                continue
                #print i, j
            
        for j in range(len(iAreas.Branch(i))-1, halfWayCounter-1, -1):
            if any(iSrfs.Branch(i)[j] in mergeSrf for mergeSrf in mergedSrfs)==False:
               #print i, j #print srfs not in the merged list
                brepCurrent = iSrfs.Branch(i)[j]
                brepNext = iSrfs.Branch(i)[j-1]
                if to_Check_ReverseCount(i, j)[0]==True:
                    mergeSrf.append(iSrfs.Branch(i)[j])
                    mergeSrf.append(iSrfs.Branch(i)[j-1])
                    #mergedSrf = rg.Brep.MergeSurfaces(iSrfs.Branch(i)[j], iSrfs.Branch(i)[j+1], 0.1, 0.1)
                    mergedSrfs.append(mergeSrf)
    #               print i, j
                else:
                    unmergedSrfs.append(iSrfs.Branch(i)[j])
    
                    #print i, j
    
            else:# if the existing srf is already in the merged srf list
                continue
                #print i, j

    mergedSrfTree.append(mergedSrfs)
    unmergedSrfTree.append(unmergedSrfs)
    
# remove any empty sublist
def clean_nested(l):
    cleaned = []
    for v in l:
        if isinstance(v, list):
            v = clean_nested(v)
            if not v:
                continue
        cleaned.append(v)
    return cleaned
    
print len(clean_nested(unmergedSrfTree)[2])

# if the i in each sublist is same, then merge these two sublists
#uniqueMergedSrfs = [[]]
#for i in range(0, len(clean_nested(mergedSrfTree))):
#    branchIndexCurrent = clean_nested(mergedSrfTree)[i][0]
#    for j in range(0, len(clean_nested(mergedSrfTree))):
#        branchIndexNext = clean_nested(mergedSrfTree)[j][0]
#        if clean_nested(mergedSrfTree)[i] != clean_nested(mergedSrfTree)[j]:
#            if branchIndexCurrent == branchIndexNext:
#                mergedSublist = list(set(clean_nested(mergedSrfTree)[i]+clean_nested(mergedSrfTree)[j]))
#                uniqueMergedSrfs.append(mergedSublist)


##find the index of the breps which are duplicate from each other
cullingIndexTree = [[]]
for i in range(1,len(clean_nested(unmergedSrfTree))):
    cullingIndex = []
    for j in range(1, len(clean_nested(unmergedSrfTree)[i])-1):
        brepA = clean_nested(unmergedSrfTree)[i][j]
        brepB = clean_nested(unmergedSrfTree)[i][j+1]
        duplicateBrep = rg.Brep.IsDuplicate(brepA, brepB, 0.1) 
        #rg.Brep.IsDuplicate() check if two breps are duplicate
        if duplicateBrep:
            cullingIndex.append(j)
    cullingIndexTree.append(cullingIndex)

oMergedSrf = th.list_to_tree(clean_nested(mergedSrfTree))
oUnmergedSrf = th.list_to_tree(clean_nested(unmergedSrfTree))
oRemoveDuplicateBreps = th.list_to_tree(cullingIndexTree)
# ---------- end python_13 ----------

# ----
# 5. Discretisation the mesh if the single
#  surface has an area larger than 1.2 square
#  meters or its edge length exceeds 1200mm
# c) split the surfaces whose areas are larger than 1.2
# 
# * if components are organge, it means no surfaces need to be further split
offset_verticall_crvs_2 = Curve(simplify(offset_verticall_crvs))
clean_3 = CleanTree(RemoveNulls=True, RemoveInvalid=True, RemoveEmpty=True, Tree=srf_needs_to_be_split)
brep_to_split = Brep(clean_3)
python_14 = GhPythonScript(iBreps=flatten(brep_to_split), iCrvs=flatten(offset_verticall_crvs_2))  # -> out, oIndex; inputs iBreps: list of Brep, iCrvs: list of Curve
# ---------- python_14: Python ----------
import Rhino.Geometry as rg


index = []
for i in range(0, len(iCrvs)):
    for j in range(0, len(iBreps)):
        result = rg.Intersect.Intersection.CurveBrep(iCrvs[i], iBreps[j], 0.1)
        print len(result[2]) #print the number of the intersecting points
        if len(result[2]) > 0:
            index.append(i)
        else:
            continue

oIndex = list(set(index))
# ---------- end python_14 ----------
item_11 = ListItem(List=offset_verticall_crvs_2, Index=python_14.oIndex, Wrap=True)
selected_curves_that_intersect_with_the = Geometry(item_11)  # "selected curves that intersect with the srfs to be split"
wires_3 = BrepWireframe(Brep=brep_to_split, Density=-1)
cp = ControlPoints(Curve=wires_3)  # -> simplify(Points), Weights, Knots
path_mapper_3 = PathMapper(cp.Points, source="{A; B; C}", target="{A; B}")
duppt_3 = RemoveDuplicatePts(Points=path_mapper_3, Tolerance=0.01)  # -> simplify(UniquePoints)
partition = PartitionList(List=duppt_3, Size=2)
shift = ShiftList(List=duppt_3, Shift="-1", Wrap=True)
avr_3 = Average(Input=partition)  # -> simplify(ArithmeticMean)
points_7 = PointList(Points=shift, Size=50)
path_mapper_4 = PathMapper(avr_3, source="{A; B; C}", target="{A; B}")
bang = ExplodeTree(Data=path_mapper_4)  # -> Branch0, Branch1, Branch2, Branch3
geo_3 = Geometry(bang.Branch1)
dup = DuplicateData(Data=path_mapper_4, Number=2, Order=True)
item_12 = ListItem(List=dup, Index=0, Wrap=True)  # -> Item, Item1, Item2, Item3
ins_19 = InsertItems(List=shift, Item=item_12.Item, Indices="2", Wrap=True)
ins_20 = InsertItems(List=ins_19, Item=item_12.Item1, Indices="3", Wrap=True)
ins_21 = InsertItems(List=ins_20, Item=item_12.Item3, Indices="4", Wrap=True)
ins_22 = InsertItems(List=ins_21, Item=item_12.Item2, Indices="5", Wrap=True)
partition_2 = PartitionList(List=ins_22, Size=4)  # -> simplify(Chunks)
python_15 = GhPythonScript(iPts=partition_2)  # -> out, oSurfaces; inputs iPts: tree of Point3d
# ---------- python_15: Python ----------
import Rhino.Geometry as rg

print iPts.BranchCount

surfaces = []
for i in range(0,iPts.BranchCount):
    
    pointA = iPts.Branch(i)[0]
    pointB = iPts.Branch(i)[1]
    pointC = iPts.Branch(i)[2]
    pointD = iPts.Branch(i)[3]
    
    surface = rg.NurbsSurface.CreateFromCorners(pointA, pointB, pointC, pointD)
    surfaces.append(surface)
    

oSurfaces = surfaces
# ---------- end python_15 ----------
partition_3 = PartitionList(List=python_15.oSurfaces, Size=4)  # -> simplify(Chunks)
tstat_4 = TreeStatistics(Tree=partition_3)  # -> Paths, Length, Count
replace_4 = ReplacePaths(Data=partition_3, Search=tstat_4.Paths, Replace=flatten(python_14.oIndex))
split_surfaces = Surface(replace_4)
wires_4 = BrepWireframe(Brep=split_surfaces, Density=-1)
area_6 = Area(Geometry=split_surfaces)  # -> Area, Centroid
lenseg_2 = SegmentLengths(Curve=wires_4)  # -> ShortestLength, ShortestDomain, LongestLength, LongestDomain

srf_2 = Surface(python_13.oMergedSrf)
item_13 = ListItem(List=python_13.oMergedSrf, Index=0, Wrap=True)
cull_i_6 = CullIndex(List=python_13.oMergedSrf, Indices=0, Wrap=True)  # -> simplify(List)
srf_not_to_merge = Surface(python_13.oUnmergedSrf)
path_mapper_5 = PathMapper(cull_i_6, source="{A; B}", target="{A}")
path_mapper_6 = PathMapper(item_13, source="{A; B}", target="{A}")
area_7 = Area(Geometry=path_mapper_5)  # -> Area, Centroid
duppt_4 = RemoveDuplicatePts(Points=area_7.Centroid, Tolerance=0.01)  # -> simplify(UniquePoints)
mindex_6 = MemberIndex(Set=area_7.Centroid, Member=duppt_4)  # -> simplify(Index), Count
area_8 = Area(Geometry=srf_not_to_merge)  # -> Area, Centroid
pt_18 = Point(duppt_4)
item_14 = ListItem(List=mindex_6.Index, Index=0, Wrap=True)
python_16 = GhPythonScript(iMergeSrfCenter=pt_18, iUnmergeSrfCenter=area_8.Centroid)  # -> out, simplify(cullingIndices); inputs iMergeSrfCenter: tree, iUnmergeSrfCenter: tree of Point3d
# ---------- python_16: Python ----------
import Rhino.Geometry as rg
import ghpythonlib.treehelpers as th


print iMergeSrfCenter.Branch(0)[2]


cullingIndices = [[]]
#cullingPattern = [[]]
for i in range(0, iUnmergeSrfCenter.BranchCount):
    cullingIndex = []
    #culling = []
    for j in range(0, len(iUnmergeSrfCenter.Branch(i))):
        unMergeSrfCenter = iUnmergeSrfCenter.Branch(i)[j]
        for m in range(0, iMergeSrfCenter.BranchCount):
            for n in range(0, len(iMergeSrfCenter.Branch(m))):
                mergeSrfCenter = iMergeSrfCenter.Branch(m)[n]
                #check distance between unMergeSrfCenter and mergeSrfCenter
                # if veryvery close, meaning they are two duplicate surface
                if mergeSrfCenter != None:
                    dist = unMergeSrfCenter.DistanceTo(mergeSrfCenter)
                    if dist < 0.1:
                        print i, j, m, n, True, dist
                        cullingIndex.append(j)
                        #culling.append("True")
                    else:
                        print i, j, m, n, False, dist
                        #culling.append("False")
                        continue
    cullingIndices.append(cullingIndex)
        #cullingPattern.append(culling)

# remove any empty sublist
#def clean_nested(l):
#    cleaned = []
#    for v in l:
#        if isinstance(v, list):
#            v = clean_nested(v)
#            if not v:
#                continue
#        cleaned.append(v)
#    return cleaned
#
#cleanedTree = clean_nested(cullingIndices)

#remove duplicates
indicesToRemove = []
for i in range(0, len(cullingIndices)):
    uniqueList = list(set(cullingIndices[i]))
    indicesToRemove.append(uniqueList)

cullingIndices = th.list_to_tree(cullingIndices)
# ---------- end python_16 ----------
path_mapper_7 = PathMapper(item_14, source="{A; B}", target="{A}")
split = SplitTree(Data=python_16.cullingIndices, Masks=flatten("{0}"))  # -> Positive, Negative
item_15 = ListItem(List=path_mapper_6, Index=0, Wrap=True)
item_16 = ListItem(List=path_mapper_5, Index=path_mapper_7, Wrap=True)
tstat_5 = TreeStatistics(Tree=item_16)  # -> Paths, Length, Count
cull_i_7 = CullIndex(List=srf_not_to_merge, Indices=split.Negative, Wrap=True)
replace_5 = ReplacePaths(Data=item_16, Search=tstat_5.Paths, Replace=flatten(item_15))
partition_4 = PartitionList(List=replace_5, Size=2)
join_3 = BrepJoin(Breps=partition_4)  # -> Breps, Closed
path_mapper_8 = PathMapper(join_3.Breps, source="{A; B}", target="{A}")
merged_srfs_1st_time = Brep(simplify(path_mapper_8))
wires_5 = BrepWireframe(Brep=merged_srfs_1st_time, Density=-1)  # -> simplify(Wireframe)
lng_2 = ListLength(List=wires_5)
path_mapper_9 = PathMapper(wires_5, source="{A; B}", target="{A}")
item_17 = ListItem(List=flatten(lng_2), Index=0, Wrap=True)
srf_not_to_merge_2 = Surface(simplify(cull_i_7))

panel_14 = Panel(path_mapper_5)
area_9 = Area(Geometry=merged_srfs_1st_time)  # -> Area, Centroid
points_8 = PointList(Points=area_9.Centroid, Size=0.1)

# ----
# 2nd time to find the
# srfs to merge
python_17 = GhPythonScript(
    iAreas=area_9.Area,
    iSrfs=merged_srfs_1st_time,
    iCrvs=path_mapper_9,
    maxArea=number_slider_4,
    maxLength=maxlength,
    listLength=item_17)  # -> out, simplify(oMergedSrf), simplify(oUnmergedSrf), simplify(oRemoveDuplicateBreps); inputs iAreas: tree, iSrfs: tree of Brep, iCrvs: tree of Curve, listLength: Int32
# ---------- python_17: Python ----------
import ghpythonlib.treehelpers as th
import Rhino.Geometry as rg
import math as math

print iAreas.BranchCount
print len(iAreas.Branch(8))
print iAreas.Branch(0)[0]
print len(iAreas.Branch(0))

adjacency8 = rg.Intersect.Intersection.BrepBrep(iSrfs.Branch(8)[0], iSrfs.Branch(8)[1], 0.01)
print adjacency8[0], len(adjacency8[1])

adjacency0 = rg.Intersect.Intersection.BrepBrep(iSrfs.Branch(0)[0], iSrfs.Branch(0)[1], 0.01)
print adjacency0[0], len(adjacency0[1])

#rg.Brep.GetArea()
#print iSrfs.Branch(8)[6].GetArea()

step = listLength
def to_Check(i, j):
    lineA = iCrvs.Branch(i)[j*step]
    lineB = iCrvs.Branch(i)[j*step+4]
    # top lines of brepCurrent
    lineC = iCrvs.Branch(i)[j*step+2]
    lineD = iCrvs.Branch(i)[j*step+6]
    #bottom lines of brepNext
    lineM = iCrvs.Branch(i)[(j+1)*step]
    lineN = iCrvs.Branch(i)[(j+1)*step+4]
    #top lines of brepNext
    lineO = iCrvs.Branch(i)[(j+1)*step+2]
    lineP = iCrvs.Branch(i)[(j+1)*step+6]
    #calculate the length of the 4bottom lines
    lenBottom = lineA.GetLength()+lineB.GetLength()+lineM.GetLength()+lineN.GetLength()
    #calculate the length of the 4top lines
    lenTop = lineC.GetLength()+lineD.GetLength()+lineO.GetLength()+lineP.GetLength()
                        
    #get the area of these two adjacent srfs in square meters
    areaCurrent = iAreas.Branch(i)[j]/1000000
    areaNext = iAreas.Branch(i)[j+1]/1000000
    #print i, j, lenBottom, lenTop, areaCurrent+areaNext
    #check the sum of adancent lines are larger than 1200mm
    if areaCurrent+areaNext < maxArea and lenBottom < maxLength and lenTop < maxLength:
        return True, i, j, lenBottom, lenTop, areaCurrent+areaNext
    else:
        return False, i, j, lenBottom, lenTop, areaCurrent+areaNext


def to_Check_ReverseCount(i, j):
    lineA = iCrvs.Branch(i)[j*step]
    lineB = iCrvs.Branch(i)[j*step+4]
    # top lines of brepCurrent
    lineC = iCrvs.Branch(i)[j*step+2]
    lineD = iCrvs.Branch(i)[j*step+5]
    #bottom lines of brepNext
    lineM = iCrvs.Branch(i)[(j+1)*step]
    lineN = iCrvs.Branch(i)[(j+1)*step+4]
    #top lines of brepNext
    lineO = iCrvs.Branch(i)[(j+1)*step +2]
    lineP = iCrvs.Branch(i)[(j+1)*step +5]
    #calculate the length of the 4bottom lines
    lenBottom = lineA.GetLength()+lineB.GetLength()+lineM.GetLength()+lineN.GetLength()
    #calculate the length of the 4top lines
    lenTop = lineC.GetLength()+lineD.GetLength()+lineO.GetLength()+lineP.GetLength()
                        
    #get the area of these two adjacent srfs in square meters
    areaCurrent = iAreas.Branch(i)[j]/1000000
    areaNext = iAreas.Branch(i)[j+1]/1000000
    #print i, j, lenBottom, lenTop, areaCurrent+areaNext
    #check the sum of adancent lines are larger than 1200mm
    if areaCurrent+areaNext < maxArea and lenBottom < maxLength and lenTop < maxLength:
        return True, i, j, lenBottom, lenTop, areaCurrent+areaNext
    else:
        return False, i, j, lenBottom, lenTop, areaCurrent+areaNext


print to_Check(3, 0)
print to_Check_ReverseCount(3, 2)
print to_Check(3, 1)
#print to_Check_ReverseCount(3, 3)


print to_Check(6, 0)
print to_Check_ReverseCount(6, 4)
print to_Check(6, 1)
print to_Check_ReverseCount(6, 5)
print to_Check(6, 2)
#print to_Check_ReverseCount(6, 6)
#print to_Check(6, 3)

print to_Check(7, 0)
print to_Check_ReverseCount(7, 4)
print to_Check(7, 1)
print to_Check_ReverseCount(7, 5)
print to_Check(7, 2)

print to_Check(8, 0)
print to_Check_ReverseCount(8, 4)
print to_Check(8, 1)
print to_Check_ReverseCount(8, 5)
print to_Check(8, 2)


mergedSrfTree = [[]]
unmergedSrfTree = [[]]

for i in range (0, iAreas.BranchCount):
    mergedSrfs = []
    unmergedSrfs = []
    #mergedSrfs.append(10)
    if len(iSrfs.Branch(i))==1:
        #unmergedSrfs.append(i)
        unmergedSrfs.append(iSrfs.Branch(i)[j])
    else:
        mergeSrf = []
        mergeSrf.append(i)
        halfWayCounter = int(math.ceil(len(iAreas.Branch(i))/2))
#        print i, halfWayCounter
        for j in range(0, halfWayCounter):
            if any(iSrfs.Branch(i)[j] in mergeSrf for mergeSrf in mergedSrfs)==False:
                #print i, j #print srfs not in the merged list
                #CHECK IF THE BREPS ARE ADJACENT
                brepCurrent = iSrfs.Branch(i)[j]
                brepNext = iSrfs.Branch(i)[j+1]
                adjacency = rg.Intersect.Intersection.BrepBrep(brepCurrent, brepNext, 0.1)
                if len(adjacency[1]) > 0 and to_Check(i, j)[0]==True:
                    mergeSrf.append(iSrfs.Branch(i)[j])
                    mergeSrf.append(iSrfs.Branch(i)[j+1])
                    #mergedSrf = rg.Brep.MergeSurfaces(iSrfs.Branch(i)[j], iSrfs.Branch(i)[j+1], 0.1, 0.1)
                    mergedSrfs.append(mergeSrf)
#                    print i, j
                else:
                    unmergedSrfs.append(iSrfs.Branch(i)[j])
            else:# if the existing srf is already in the merged srf list
                continue
                #print i, j
            
        for j in range(halfWayCounter, len(iAreas.Branch(i))-1):
            if any(iSrfs.Branch(i)[j] in mergeSrf for mergeSrf in mergedSrfs)==False:
               #print i, j #print srfs not in the merged list
                #CHECK IF THE BREPS ARE ADJACENT
                brepCurrent = iSrfs.Branch(i)[j]
                brepNext = iSrfs.Branch(i)[j+1]
                adjacency = rg.Intersect.Intersection.BrepBrep(brepCurrent, brepNext, 0.1)
                if len(adjacency[1]) > 0 and to_Check_ReverseCount(i, j)[0]==True:
                    mergeSrf.append(iSrfs.Branch(i)[j])
                    mergeSrf.append(iSrfs.Branch(i)[j+1])
                    #mergedSrf = rg.Brep.MergeSurfaces(iSrfs.Branch(i)[j], iSrfs.Branch(i)[j+1], 0.1, 0.1)
                    mergedSrfs.append(mergeSrf)
#                    print i, j
                else:
                    unmergedSrfs.append(iSrfs.Branch(i)[j])
    
                    #print i, j
    
            else:# if the existing srf is already in the merged srf list
                continue
                #print i, j
    
#    if i ==6:
#        k= len(iAreas.Branch(i))-1
#        InMerged =  bool(iSrfs.Branch(i)[k] in mergeSrf for mergeSrf in mergedSrfs)
#        InUnMerged = bool(iSrfs.Branch(i)[k] in unmergedSrfs)
#        print i, k, InMerged, InUnMerged
    
    
    #check if the last brep in every branch: if it is not in merged srfs and not in unmerged, then append to unmerged


    k= len(iAreas.Branch(i))-1
    InMerged =  bool(iSrfs.Branch(i)[k] in mergeSrf for mergeSrf in mergedSrfs)
    InUnMerged = iSrfs.Branch(i)[k] in unmergedSrfs
    print i, k, InMerged, InUnMerged
#    if InMerged == 0 and InUnMerged == 0:
#        print i, k, InMerged, InUnMerged , "add"
#    #   unmergedSrfs.append(iSrfs.Branch(i)[k])
#    if InMerged == 0 and InUnMerged == 1:
#        print i, k, InMerged, InUnMerged , "nothing"
#    #   break
#    if InMerged == 1 and InUnMerged == 0:
#        print i, k, InMerged, InUnMerged , "nothing"
#    #   break
#    if InMerged == 1 and InUnMerged == 1:
#        print i, k, InMerged, InUnMerged , "remove"
#    #   unmergedSrfs.remove(iSrfs.Branch(i)[k])
#            

    
    
    
    
    if (iSrfs.Branch(i)[k] not in mergeSrf for mergeSrf in mergedSrfs) and (iSrfs.Branch(i)[k] not in unmergedSrfs) == True:
        print i, k, "not in mergedSrf, also not in unmerged, to add"
        unmergedSrfs.append(iSrfs.Branch(i)[k])

    elif(iSrfs.Branch(i)[k] in mergeSrf for mergeSrf in mergedSrfs)  and (iSrfs.Branch(i)[k] in unmergedSrfs) == True:
        print i, k, "already in mergedSrf, also in unmerged, to remove"
        unmergedSrfs.remove(iSrfs.Branch(i)[k])
    

    mergedSrfTree.append(mergedSrfs)
    unmergedSrfTree.append(unmergedSrfs)
    
# remove any empty sublist
def clean_nested(l):
    cleaned = []
    for v in l:
        if isinstance(v, list):
            v = clean_nested(v)
            if not v:
                continue
        cleaned.append(v)
    return cleaned
    
#print len(clean_nested(unmergedSrfTree)[2])

# if the i in each sublist is same, then merge these two sublists
#uniqueMergedSrfs = [[]]
#for i in range(0, len(clean_nested(mergedSrfTree))):
#    branchIndexCurrent = clean_nested(mergedSrfTree)[i][0]
#    for j in range(0, len(clean_nested(mergedSrfTree))):
#        branchIndexNext = clean_nested(mergedSrfTree)[j][0]
#        if clean_nested(mergedSrfTree)[i] != clean_nested(mergedSrfTree)[j]:
#            if branchIndexCurrent == branchIndexNext:
#                mergedSublist = list(set(clean_nested(mergedSrfTree)[i]+clean_nested(mergedSrfTree)[j]))
#                uniqueMergedSrfs.append(mergedSublist)


##find the index of the breps which are duplicate from each other
cullingIndexTree = [[]]
for i in range(1,len(clean_nested(unmergedSrfTree))):
    cullingIndex = []
    for j in range(1, len(clean_nested(unmergedSrfTree)[i])-1):
        brepA = clean_nested(unmergedSrfTree)[i][j]
        brepB = clean_nested(unmergedSrfTree)[i][j+1]
        duplicateBrep = rg.Brep.IsDuplicate(brepA, brepB, 0.1) 
        #rg.Brep.IsDuplicate() check if two breps are duplicate
        if duplicateBrep:
            cullingIndex.append(j)
    cullingIndexTree.append(cullingIndex)

oMergedSrf = th.list_to_tree(clean_nested(mergedSrfTree))
oUnmergedSrf = th.list_to_tree(clean_nested(unmergedSrfTree))
oRemoveDuplicateBreps = th.list_to_tree(cullingIndexTree)
# ---------- end python_17 ----------

# ----
# match the data tree structure to the data tree before merging
cull_i_8 = CullIndex(List=python_17.oMergedSrf, Indices=0, Wrap=True)  # -> simplify(List)
item_18 = ListItem(List=python_17.oMergedSrf, Index=0, Wrap=True)
path_mapper_10 = PathMapper(cull_i_8, source="{A; B}", target="{A}")
path_mapper_11 = PathMapper(item_18, source="{A; B}", target="{A}")
area_10 = Area(Geometry=path_mapper_10)  # -> Area, Centroid
duppt_5 = RemoveDuplicatePts(Points=area_10.Centroid, Tolerance=0.01)
mindex_7 = MemberIndex(Set=area_10.Centroid, Member=duppt_5)  # -> simplify(Index), Count
item_19 = ListItem(List=mindex_7.Index, Index=0, Wrap=True)
path_mapper_12 = PathMapper(item_19, source="{A; B}", target="{A}")
item_20 = ListItem(List=path_mapper_11, Index=0, Wrap=True)
item_21 = ListItem(List=path_mapper_10, Index=path_mapper_12, Wrap=True)
tstat_6 = TreeStatistics(Tree=item_21)  # -> Paths, Length, Count
replace_6 = ReplacePaths(Data=item_21, Search=tstat_6.Paths, Replace=flatten(item_20))
partition_5 = PartitionList(List=replace_6, Size=2)

geo_4 = Geometry(python_17.oMergedSrf)
geo_5 = Geometry(python_17.oUnmergedSrf)
join_4 = BrepJoin(Breps=partition_5)  # -> Breps, Closed
geo_6 = Geometry(join_4.Breps)
path_mapper_13 = PathMapper(geo_6, source="{A; B}", target="{A}")
merge_10 = Merge(Data1=path_mapper_13)

bang_2 = ExplodeTree(Data=geo_5)  # -> Branch0, Branch1, Branch2, Branch3, Branch4, Branch5, Branch6, Branch7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
cull_i_9 = CullIndex(List=bang_2.Branch6, Indices=-1, Wrap=True)  # -> simplify(List)
cull_i_10 = CullIndex(List=bang_2.Branch7, Indices=-1, Wrap=True)  # -> simplify(List)
path_mapper_14 = PathMapper(cull_i_10, source="{A; B}", target="{A}")
path_mapper_15 = PathMapper(cull_i_9, source="{A; B}", target="{A}")
merge_11 = Merge(
    Data1=bang_2.Branch0,
    Data2=bang_2.Branch1,
    Data3=bang_2.Branch2,
    Data4=bang_2.Branch3,
    Data5=bang_2.Branch4,
    Data6=bang_2.Branch5,
    Data7=path_mapper_15,
    Data8=path_mapper_14,
    Data9=bang_2.Branch8,
    Data10=bang_2.Branch9,
    Data11=bang_2.Branch10)  # -> simplify(Result)

cull_i_11 = CullIndex(List=merge_11, Indices=python_17.oRemoveDuplicateBreps, Wrap=True)  # -> simplify(List)
unmerged_srfs = Geometry(cull_i_11)
merge_12 = Merge(Data1=merge_10, Data2=unmerged_srfs)
match = MatchTree(Tree=merge_12, Guide=merged_srfs_1st_time)
merge_13 = Merge(Data1=match, Data2=srf_not_to_merge_2, Data3=split_surfaces)

wires_6 = BrepWireframe(Brep=join_4.Breps, Density=-1)
mesh_7 = Mesh(join_4.Breps)
wbnaked_2 = WeaverbirdsNakedBoundary(MeshClosedPolylines=mesh_7)

# ----
# 5. Discretisation the mesh
# d) resort the order of the discretised srfs
panel_15 = Panel("""{8}
{9}
{10}""")
branch_2 = TreeBranch(Tree=merge_13, Path=panel_15, MaintainPaths=True)
area_11 = Area(Geometry=branch_2)  # -> Area, Centroid
dispatch_14 = Dispatch(List=branch_2, DispatchPattern=[True, False])  # -> ListA, ListB
points_9 = PointList(Points=area_11.Centroid)
geo_7 = Geometry(dispatch_14.ListB)
join_5 = BrepJoin(Breps=geo_7)  # -> Breps, Closed
panel_16 = Panel("""{0}
{1}
{2}
{3}
{4}
{5}
{6}
{7}""")
merge_14 = Merge(Data1=dispatch_14.ListA, Data2=join_5.Breps)
branch_3 = TreeBranch(Tree=merge_13, Path=panel_16, MaintainPaths=True)
merge_15 = Merge(Data1=merge_14, Data2=branch_3)
discretised_srfs = Geometry(merge_15)
area_12 = Area(Geometry=discretised_srfs)  # -> Area, Centroid
pdecon_23 = Deconstruct(Point=area_12.Centroid)  # -> XComponent, YComponent, ZComponent
sort_13 = SortList(Keys=pdecon_23.YComponent, ValuesA=discretised_srfs)  # -> Keys, ValuesA
bang_3 = ExplodeTree(Data=sort_13.ValuesA)  # -> Branch0, Branch1, Branch2
bang_4 = ExplodeTree(Data=sort_13.ValuesA)  # -> Branch0, Branch1, Branch2, Branch3, Branch4, Branch5, Branch6, Branch7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
geo_8 = Geometry(bang_3.Branch2)
panel_17 = Panel("""1
10""")
cull_i_12 = CullIndex(List=bang_4.Branch2, Indices=panel_17, Wrap=True)  # -> simplify(List)
item_22 = ListItem(List=geo_8, Index=panel_17, Wrap=True)
debrep = DeconstructBrep(Brep=item_22)  # -> simplify(flatten(Faces)), Edges, Vertices
merge_16 = Merge(Data1=cull_i_12, Data2=debrep.Faces)  # -> flatten(Result)
area_13 = Area(Geometry=merge_16)  # -> Area, Centroid
pdecon_24 = Deconstruct(Point=area_13.Centroid)  # -> XComponent, YComponent, ZComponent
panel_18 = Panel("""2
3""")
panel_19 = Panel("""10
11""")
sort_14 = SortList(Keys=pdecon_24.YComponent, ValuesA=merge_16)  # -> Keys, ValuesA
cull_i_13 = CullIndex(List=sort_14.ValuesA, Indices=[panel_18, panel_19], Wrap=True)
item_23 = ListItem(List=sort_14.ValuesA, Index=panel_18, Wrap=True)
item_24 = ListItem(List=sort_14.ValuesA, Index=panel_19, Wrap=True)
join_6 = BrepJoin(Breps=item_23)  # -> Breps, Closed
join_7 = BrepJoin(Breps=item_24)  # -> Breps, Closed
merge_17 = Merge(Data1=join_6.Breps, Data2=cull_i_13, Data3=join_7.Breps)  # -> simplify(flatten(Result))
entwine = Entwine(
    Branch00=bang_4.Branch0,
    Branch01=bang_4.Branch1,
    Branch02=merge_17,
    Branch03=bang_4.Branch3,
    Branch04=bang_4.Branch4,
    Branch05=bang_4.Branch5,
    Branch06=bang_4.Branch6,
    Branch07=bang_4.Branch7,
    Branch08=bang_4.Branch8,
    Branch09=bang_4.Branch9,
    Branch010=bang_4.Branch10,
    FlattenInputs=True)  # -> simplify(Result)
smesh = SimpleMesh(Brep=entwine)
wbjoin = WeaverbirdsJoinMeshesAndWeld(Mesh=flatten(smesh), Weld=False)
wbnaked_3 = WeaverbirdsNakedBoundary(MeshClosedPolylines=smesh)

# ----
# Output
discretised_meshes = Mesh(smesh)
long_fibers = Curve(crv_2)
discretised_breps = Brep(entwine)
joined_mesh = Mesh(wbjoin)
discretised_panel_crvs_2 = Geometry(wbnaked_3)

# ----
# Check Areas and Dimensions
lenseg_3 = SegmentLengths(Curve=discretised_panel_crvs_2)  # -> ShortestLength, ShortestDomain, LongestLength, LongestDomain
area_14 = MeshArea(Mesh=smesh)  # -> Area, Centroid
division_10 = Division(A=area_14.Area, B="1000000")
larger_4 = LargerThan(FirstNumber=lenseg_3.LongestLength, SecondNumber="1200")  # -> LargerThan, OrEqualTo
larger_5 = LargerThan(FirstNumber=division_10, SecondNumber="1.20")  # -> LargerThan, OrEqualTo
panel_20 = Panel(larger_4.LargerThan)
panel_21 = Panel(larger_5.LargerThan)
dispatch_15 = Dispatch(List=discretised_panel_crvs_2, DispatchPattern=larger_4.LargerThan)  # -> ListA, ListB
dispatch_16 = Dispatch(List=smesh, DispatchPattern=larger_5.LargerThan)  # -> ListA, ListB
panels_that_does_not_meet_the_requiremen = Geometry(dispatch_15.ListA)  # "panels that does not meet the requirement"
panels_that_does_not_meet_the_requiremen_2 = Geometry(dispatch_16.ListA)  # "panels that does not meet the requirement"

tstat_7 = TreeStatistics(Tree=discretised_breps)  # -> Paths, Length, Count
lng_3 = ListLength(List=flatten(discretised_breps))
panel_22 = Panel(tstat_7.Length)
previewlw = CustomPreviewLineweights(Geometry=discretised_panel_crvs_2, Shader=ColourSwatch(SwatchColor=RGB(87, 87, 87)), Thickness=2, Absolute=False)
previewlw_2 = CustomPreviewLineweights(Geometry=long_fibers, Shader=ColourSwatch(SwatchColor=RGB(212, 126, 80)), Thickness=2, Absolute=False)
