# Grasshopper definition ST04_planarization with abm_230207.gh (Grasshopper 1.0.7)
# plug-ins: ABxM.Grasshopper, Kangaroo2 Components, Kangaroo Components, NGon, Weaverbird

crv = Curve(graft([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]))
pt = Point([Point(-28.80869571, -5.488914704, 0), Point(-28.59566322, -4.702266076, 0.512305494), Point(-28.27839806, -3.949658279, 1.00408241), Point(-27.83599208, -3.230265905, 1.452128725), Point(-27.30432301, -2.598221043, 1.783911967), Point(-26.67581171, -2.047481259, 1.944372054)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])
# Planarization with ABM
panel = Panel("")

discretised_panel_crvs = Geometry(Tree({0}: [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], {1}: [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], {2}: [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], {3}: [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], {4}: [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], {5}: [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], {6}: [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], {7}: [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], {8}: [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], {9}: [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], {10}: [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]))
pt_2 = Point(Tree({0}: [Point(-28.80869571, -5.488914704, 0), Point(-29.2844646, -4.778138399, 0), Point(-29.79644902, -3.877004597, 0), Point(-29.99335224, -3.46238897, 0), Point(-30.25587384, -2.809057482, 0), Point(-30.50013904, -2.004107651, 0), Point(-30.69197586, -0.9352037661, 0), Point(-30.73847423, -0.007161663742, 0), Point(-30.67610532, 0.9183202302, 0), Point(-30.47291596, 1.982860355, 0), Point(-30.22863941, 2.785337783, 0), Point(-29.97305492, 3.438443243, 0), Point(-29.78296623, 3.856696825, 0), Point(-29.29272298, 4.774939497, 0), Point(-28.84109311, 5.506991603, 0)], {1}: [Point(-28.59566322, -4.702266076, 0.512305494), Point(-28.98260527, -4.198018695, 0.6221769549), Point(-29.45837838, -3.554111056, 0.7600760078), Point(-29.67660694, -3.17551677, 0.8208070497), Point(-29.94901277, -2.550056838, 0.8698722881), Point(-30.18818816, -1.788380392, 0.8979182908), Point(-30.34209899, -0.8235899472, 0.9133036276), Point(-30.39826479, -0.007119332409, 0.9193109429), Point(-30.33055222, 0.8082303327, 0.9139828195), Point(-30.16863904, 1.769642979, 0.8999842004), Point(-29.92819336, 2.525546695, 0.8704121781), Point(-29.65476188, 3.148448906, 0.8165072591), Point(-29.44305622, 3.524172231, 0.7534218269), Point(-28.98790105, 4.19094644, 0.6127017661), Point(-28.61991224, 4.716731228, 0.5014389827)], {2}: [Point(-28.27839806, -3.949658279, 1.00408241), Point(-28.60293308, -3.6146853, 1.209340382), Point(-29.02109468, -3.161623792, 1.473068222), Point(-29.25589625, -2.835264454, 1.608030921), Point(-29.5456521, -2.271439021, 1.724803086), Point(-29.78507753, -1.57717988, 1.789946313), Point(-29.92577464, -0.7244462115, 1.823494821), Point(-29.97393887, -0.007078600984, 1.835615731), Point(-29.91516889, 0.7087982172, 1.823296825), Point(-29.76574056, 1.558300895, 1.789444409), Point(-29.52567291, 2.244409392, 1.722135093), Point(-29.23624274, 2.802264558, 1.599354169), Point(-29.00905063, 3.127020658, 1.461568477), Point(-28.61611456, 3.618786925, 1.183900006), Point(-28.31318955, 3.991643072, 0.9654561548)], {3}: [Point(-27.83599208, -3.230265905, 1.452128725), Point(-28.1262365, -3.007578246, 1.72136721), Point(-28.50030369, -2.680545088, 2.071073851), Point(-28.71195059, -2.397368835, 2.261354697), Point(-28.98691387, -1.91459513, 2.45176307), Point(-29.21353537, -1.329046441, 2.571985415), Point(-29.3378626, -0.6147480844, 2.630968366), Point(-29.38004922, -0.007032860858, 2.652231066), Point(-29.33012954, 0.5994700314, 2.631551326), Point(-29.1981955, 1.306965485, 2.570434469), Point(-28.96989998, 1.883364918, 2.445133008), Point(-28.69813478, 2.36115577, 2.252148292), Point(-28.49304836, 2.649062344, 2.063081484), Point(-28.1402815, 3.012270417, 1.69651923), Point(-27.86830028, 3.268186799, 1.409520222)], {4}: [Point(-27.30432301, -2.598221043, 1.783911967), Point(-27.5641778, -2.415535437, 2.099473837), Point(-27.89133729, -2.138140193, 2.510996065), Point(-28.05831841, -1.882948056, 2.731278097), Point(-28.26750211, -1.475808861, 2.95822554), Point(-28.42835427, -1.026332881, 3.107225916), Point(-28.51600677, -0.4821067501, 3.185950188), Point(-28.54745633, -0.007009656779, 3.217083888), Point(-28.50970185, 0.4675862396, 3.186898272), Point(-28.41519374, 1.00516496, 3.104619387), Point(-28.25181425, 1.451382644, 2.951818516), Point(-28.04671103, 1.853956578, 2.726690826), Point(-27.88467242, 2.109617316, 2.50567024), Point(-27.563857, 2.401531909, 2.084658316), Point(-27.30748268, 2.598274778, 1.759889138)], {5}: [Point(-26.67581171, -2.047481259, 1.944372054), Point(-26.89879304, -1.871362109, 2.289607047), Point(-27.17071495, -1.601441732, 2.729515888), Point(-27.28598546, -1.362430514, 2.943818708), Point(-27.41273622, -1.031464142, 3.146405444), Point(-27.49859056, -0.7109853437, 3.271571542), Point(-27.54081115, -0.340514742, 3.343645033), Point(-27.55610577, -0.006981659395, 3.373010131), Point(-27.5352891, 0.3247077828, 3.342402532), Point(-27.48715466, 0.6917281622, 3.267632611), Point(-27.4001309, 1.007595607, 3.140169871), Point(-27.27574621, 1.335636553, 2.936861049), Point(-27.16355974, 1.575289189, 2.723590531), Point(-26.88061036, 1.847545868, 2.273269447), Point(-26.64472541, 2.025287752, 1.917173365)], {6}: [Point(-25.89293122, -1.564065334, 1.851750264), Point(-26.10219395, -1.421976214, 2.212901965), Point(-26.34259295, -1.195046918, 2.662086232), Point(-26.41783365, -0.9747990164, 2.857932243), Point(-26.49484587, -0.6943430623, 3.030687383), Point(-26.5402195, -0.4611934614, 3.125186225), Point(-26.55799242, -0.2173658011, 3.169734084), Point(-26.56347425, -0.00704550836, 3.186604869), Point(-26.55371496, 0.2020965953, 3.166911007), Point(-26.53121745, 0.4439234625, 3.11801687), Point(-26.48353226, 0.6761811892, 3.022521433), Point(-26.40797522, 0.9542035696, 2.850690933), Point(-26.33614397, 1.174793864, 2.656162219), Point(-26.10269903, 1.41354544, 2.199625721), Point(-25.89836364, 1.566722093, 1.829462075)], {7}: [Point(-25.18137061, -1.256580253, 1.611337924), Point(-25.34906655, -1.1061382, 1.942775223), Point(-25.53239548, -0.8861748713, 2.34084604), Point(-25.5741058, -0.702829643, 2.498548373), Point(-25.61721466, -0.4814220441, 2.633819359), Point(-25.64358808, -0.3108812814, 2.703206519), Point(-25.65247782, -0.1446810955, 2.733208385), Point(-25.65503595, -0.007047871701, 2.743640621), Point(-25.64918498, 0.1299980927, 2.730549065), Point(-25.63632439, 0.2953379997, 2.697165631), Point(-25.60869934, 0.4645403079, 2.626386981), Point(-25.56659015, 0.6848442109, 2.491247251), Point(-25.52686617, 0.868259611, 2.335175271), Point(-25.34169587, 1.094569569, 1.928217443), Point(-25.17072846, 1.251133669, 1.586742196)], {8}: [Point(-24.58368845, -1.064511099, 1.290172075), Point(-24.67138877, -0.9048797385, 1.554129195), Point(-24.76532725, -0.6863385525, 1.867343007), Point(-24.78380496, -0.5306159495, 1.984575539), Point(-24.80631055, -0.3514517342, 2.082744917), Point(-24.8216092, -0.2213824859, 2.131608542), Point(-24.82635937, -0.1013686717, 2.151719433), Point(-24.82759621, -0.007058890515, 2.158490465), Point(-24.82387366, 0.08704515912, 2.14977572), Point(-24.81641562, 0.2066661738, 2.126758154), Point(-24.80033018, 0.3360686118, 2.076500324), Point(-24.7783783, 0.5146745046, 1.97853269), Point(-24.76138134, 0.6703344135, 1.862593312), Point(-24.66778321, 0.8946757096, 1.54316188), Point(-24.57948845, 1.060049667, 1.272051698)], {9}: [Point(-24.00067363, -0.9257878708, 0.9014102895), Point(-24.02612936, -0.7679491416, 1.081033449), Point(-24.05148421, -0.5596560952, 1.293429258), Point(-24.05249064, -0.4259725055, 1.372254263), Point(-24.05798219, -0.2758568722, 1.439263728), Point(-24.06409709, -0.1713435546, 1.471984359), Point(-24.06579708, -0.07791336519, 1.484941763), Point(-24.0661813, -0.007070544747, 1.489185508), Point(-24.06440443, 0.06366769832, 1.483370873), Point(-24.06113797, 0.1568922994, 1.46823908), Point(-24.05449194, 0.2611483086, 1.434590619), Point(-24.0493438, 0.410920624, 1.367722648), Point(-24.04927925, 0.5443979567, 1.289759107), Point(-24.02435237, 0.757220371, 1.073300423), Point(-23.99879427, 0.9195909128, 0.8889917921)], {10}: [Point(-23.43259484, -0.8355080837, 0.467700336), Point(-23.41035898, -0.6735739719, 0.5557420434), Point(-23.38313516, -0.4680156507, 0.6603304478), Point(-23.37163496, -0.3516786742, 0.6999350557), Point(-23.36553259, -0.2239182808, 0.7334856343), Point(-23.36508506, -0.138145875, 0.7494357031)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], {11}: [Point(-22.87058919, -0.7996153203, 0), Point(-22.82660419, -0.6461295496, 0), Point(-22.78369749, -0.4509432217, 0), Point(-22.76568799, -0.336155747, 0), Point(-22.75200316, -0.2096034755, 0), Point(-22.7466316, -0.1283328095, 0), Point(-22.7441604, -0.05884679012, 0), Point(-22.74359157, -0.007090404514, 0), Point(-22.74410938, 0.04466764464, 0), Point(-22.74651467, 0.1141581249, 0), Point(-22.75181724, 0.1954379592, 0), Point(-22.76542432, 0.3220091247, 0), Point(-22.7834084, 0.4368115757, 0), Point(-22.82639811, 0.6319657613, 0), Point(-22.87058919, 0.7853739447, 0)]))

# ----
# Solver
run = BooleanToggle(False)
iterations = Panel("20000")

# ----
# Solver
run_2 = BooleanToggle(False)
iterations_2 = Panel("20000")

geo = Geometry([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])
srf = Surface([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])
srf_2 = Surface([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])
panel_3 = Panel(geo)
merge = Merge(Data1=srf_2, Data2=srf)
join = BrepJoin(Breps=flatten(merge))  # -> Breps, Closed
brep = Brep(join.Breps)
panel_4 = Panel(brep)

# ----
# use the curves from the circle packing
# INPUT
number_slider = Slider(3, range=0..10)
mesh = Mesh(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)
wbnaked = WeaverbirdsNakedBoundary(MeshClosedPolylines=mesh)
dual = Dual(Mesh=mesh, Type=number_slider)
explode = Explode(Curve=wbnaked, Recursive=True)  # -> Segments, Vertices
weld = WeldMesh(Mesh=dual, Angle=3.141592654)
subset = SubList(List=explode.Vertices, Domain=["0 to 6", "32 to 41"], Wrap=True)  # -> List, Index
ngfacevertices = NGonFaceVertices(Mesh=weld)  # -> simplify(Vertices), simplify(ID), TopoID
subset_2 = SubList(List=explode.Vertices, Domain="6 to 20", Wrap=True)  # -> List, Index
subset_3 = SubList(List=explode.Vertices, Domain="20 to 22", Wrap=True)  # -> List, Index
subset_4 = SubList(List=explode.Vertices, Domain="22 to 32", Wrap=True)  # -> List, Index
pline = PolyLine(Vertices=subset.List, Closed=False)
pline_2 = PolyLine(Vertices=subset_4.List, Closed=False)
pline_3 = PolyLine(Vertices=subset_2.List, Closed=False)
pline_4 = PolyLine(Vertices=subset_3.List, Closed=False)
pt_3 = Point(ngfacevertices.Vertices)
join_2 = JoinCurves(Curves=flatten(pline), Preserve=False)
merge_2 = Merge(Data1=join_2, Data2=pline_3, Data3=pline_4, Data4=pline_2)  # -> flatten(Result)
pline_5 = PolyLine(Vertices=pt_3, Closed=True)  # -> flatten(Polyline)
edge_curves = Curve(graft(merge_2))
crv_from_circle_packing = Curve(pline_5)
explode_2 = Explode(Curve=crv_from_circle_packing, Recursive=True)  # -> flatten(Segments), Vertices
explode_3 = Explode(Curve=crv_from_circle_packing, Recursive=True)  # -> Segments, Vertices
dupln = RemoveDuplicateLines(Lines=explode_2.Segments, Tolerance=0.01)
duppt = RemoveDuplicatePts(Points=flatten(explode_3.Vertices), Tolerance=0.01)
len = Length(Curve=dupln)
crv_cp = CurveClosestPoint(Point=flatten(duppt), Curve=edge_curves)  # -> Point, Parameter, Distance
smaller = SmallerThan(FirstNumber=crv_cp.Distance, SecondNumber=Slider(1, range=0..1))  # -> SmallerThan, OrEqualTo
dispatch = Dispatch(List=crv_cp.Point, DispatchPattern=smaller.SmallerThan)  # -> ListA, ListB
pts_on_edge_curve = Geometry(dispatch.ListA)
mindex = MemberIndex(Set=duppt, Member=explode_3.Vertices)  # -> simplify(Index), Count
python = GhPythonScript(iPts=duppt, iLines=explode_3.Vertices)  # -> out, simplify(iPL); inputs iPts: list of Point3d, iLines: tree of Point3d
# ---------- python: Python ----------
import Rhino.Geometry as rg
import ghpythonlib.treehelpers as th

print iLines.BranchCount

indexTree = [[]]
for i in range(0, len(iPts)):
    pointToSearch = iPts[i]
    indexList = []
    for j in range(0, iLines.BranchCount):
        for t in range(0, len(iLines.Branch(j))):
            pointToCompare = iLines.Branch(j)[t]
            dist = pointToSearch.DistanceTo(pointToCompare)
            if dist == 0:
                indexList.append(j)

    indexTree.append(list(set(indexList)))

#remove empty sublist
# list(filter(None, indexTree))


iPL = th.list_to_tree(list(filter(None, indexTree)))
# ---------- end python ----------
pdecon = Deconstruct(Point=pts_on_edge_curve)  # -> XComponent, YComponent, ZComponent
path_mapper = PathMapper(mindex.Index, source="{a; b}", target="{a}")
equals = Equality(FirstNumber=pdecon.ZComponent, SecondNumber=0)  # -> Equality, Inequality
point_indices_for_each_polyline = Panel(path_mapper)
polyline_indices_for_each_point = Panel(python.iPL)
cull = CullPattern(List=pts_on_edge_curve, CullPattern=equals.Equality)
cps = ClosestPoints(Point=flatten(pts_on_edge_curve), Cloud=duppt, Count=1)  # -> simplify(flatten(ClosestPoint)), CPIndex, Distance
cps_2 = ClosestPoints(Point=flatten(cull), Cloud=duppt, Count=1)  # -> ClosestPoint, CPIndex, Distance
duppt_2 = RemoveDuplicatePts(Points=flatten(cps_2.ClosestPoint), Tolerance=0.01)
pts_on_ground = Point(flatten(duppt_2))
mindex_2 = MemberIndex(Set=duppt, Member=pts_on_ground)  # -> simplify(flatten(Index)), Count
cull_i = CullIndex(List=duppt, Indices=mindex_2.Index, Wrap=True)

duppt_3 = RemoveDuplicatePts(Points=flatten(cps.ClosestPoint), Tolerance=0.01)

point_indices_for_each_polyline_2 = Number(path_mapper)
polyline_indices_for_each_point_2 = Number(python.iPL)

pts_on_the_edge_curves = Point(duppt_3)
mindex_3 = MemberIndex(Set=duppt, Member=pts_on_the_edge_curves)  # -> simplify(flatten(Index)), Count
cull_i_2 = CullIndex(List=duppt, Indices=mindex_3.Index, Wrap=True)
pts_not_on_edges = Point(flatten(cull_i_2))

panel_5 = Panel(pts_on_ground)
pts_not_on_ground = Point(flatten(cull_i))
ilp = ILP(point_indices_for_each_polyline_2)
P = Positions(simplify(graft(pts_not_on_ground)))
ipl = IPL(polyline_indices_for_each_point_2)

# ---- group: Planarize Behaviour
c_script = CSharpScript(
    iPL=ipl,
    iLP=ilp,
    iF=Slider(0.3, range=0..1),
    Reference="C:\USERS\SIENNASUN513\APPDATA\ROAMING\MCNEEL\RHINOCEROS\PACKAGES\7.0\ABXM_CORE\1.4.0\ABxM.Core.dll")  # -> out, oBehavior; inputs iPL: tree of Int32, iLP: tree of Int32, iF: Double
# ---------- c_script: C# usings ----------
using ABxM.Core;
using ABxM.Core.Agent;
using ABxM.Core.AgentSystem;
using ABxM.Core.Behavior;
using ABxM.Core.Environments;
# ---------- c_script: C# ----------
  behavior.PL = iPL; //polyline indices for each point
  behavior.LP = iLP; //point indices for each polyline
  behavior.Factor = iF;
  oBehavior = behavior;
# ---------- c_script: C# additional code ----------
PlanarizeBehavior behavior = new PlanarizeBehavior(1.0);

public class PlanarizeBehavior : BehaviorBase
{
  public DataTree<int> PL;
  public DataTree<int> LP;
  public double Factor = 1;

  public PlanarizeBehavior(double weight)
  {
    Weight = weight;
  }

  public override void Execute(AgentBase agent)
  {
    CartesianAgent cartesianAgent = agent as CartesianAgent;
    CartesianAgentSystem cartesianAgentSystem = cartesianAgent.AgentSystem as CartesianAgentSystem;
    //CartesianEnvironment cartesianEnvironment = cartesianAgentSystem.CartesianEnvironment;

    //======================================================================================================
    // Task: Compute the "move" vector caused by this behavior and add it to the list "cartesianAgent.Moves"
    //======================================================================================================

    // foreach polygon connect to agent, create fit plane through vert of polygon
    // get closest point of agent on plane
    // compute direction from agent to point on plane
    // add 3 directions to move list * scalar value (0.1)

    int agentID = cartesianAgent.Id;
    List<int> polylinesIndices = PL.Branch(agentID); // get the indices of polylines that the agent is adjacent to

    Vector3d moveVector = Vector3d.Zero;
    //moveVector = Vector3d.Zero;

    // now loop through all adjacent polylines
    foreach(int polyIndex in polylinesIndices)
    {
      List<int> vertexIndices = LP.Branch(polyIndex);

      List<Point3d> vertexPoints = new List<Point3d>();
      for(int i = 0; i < vertexIndices.Count - 1; i++)
        //foreach(int vertIndex in vertexIndices)
      {
        int vertIndex = vertexIndices[i];
        CartesianAgent cartAgent = (CartesianAgent) cartesianAgentSystem.Agents[vertIndex];
        vertexPoints.Add(cartAgent.Position);
      }
      Plane fitplane;
      var dummyPlane = Plane.FitPlaneToPoints(vertexPoints, out fitplane);
      Point3d targetPoint = fitplane.ClosestPoint(cartesianAgent.Position);
      Vector3d targetVector = targetPoint - cartesianAgent.Position;

      moveVector += targetVector;
    }
    moveVector /= polylinesIndices.Count;
    moveVector *= this.Factor;

    cartesianAgent.Moves.Add(moveVector);
    cartesianAgent.Weights.Add(1.0);
  }
}
# ---------- end c_script ----------

# ----
P_2 = Positions(simplify(graft(pts_on_ground)))
mindex_4 = MemberIndex(Set=duppt, Member=pts_on_ground)  # -> Index, Count
mindex_5 = MemberIndex(Set=duppt, Member=pts_not_on_ground)  # -> Index, Count
path = ConstructPath(Indices=mindex_5.Index)  # -> simplify(Branch)
path_2 = ConstructPath(Indices=mindex_4.Index)  # -> simplify(Branch)
# BEHAVIOURS
boundary_corners = Point(pts_on_the_edge_curves)
tstat = TreeStatistics(Tree=P)  # -> Paths, Length, Count
tstat_2 = TreeStatistics(Tree=P_2)  # -> Paths, Length, Count

# ----
# CartesianEnvironment
c_script_2 = CSharpScript(
    iBoundaryCorners=boundary_corners,
    Reference="C:\USERS\SIENNASUN513\APPDATA\ROAMING\MCNEEL\RHINOCEROS\PACKAGES\7.0\ABXM_CORE\1.4.0\ABxM.Core.dll")  # -> out, oEnvironment; inputs iBoundaryCorners: list of Point3d
# ---------- c_script_2: C# usings ----------
using System.IO;
using System.Linq;
using System.Data;
using System.Drawing;
using System.Reflection;
using System.Windows.Forms;
using System.Xml;
using System.Xml.Linq;
using System.Runtime.InteropServices;

using Rhino.DocObjects;
using Rhino.Collections;
using GH_IO;
using GH_IO.Serialization;
using ABxM.Core;
using ABxM.Core.Utilities;
using ABxM.Core.Environments;
using ABxM.Core.Behavior;
using ABxM.Core.Agent;
using ABxM.Core.AgentSystem;
# ---------- c_script_2: C# ----------
    oEnvironment = new CartesianEnvironment(iBoundaryCorners);
# ---------- end c_script_2 ----------

replace = ReplacePaths(Data=P, Search=tstat.Paths, Replace=flatten(path))
replace_2 = ReplacePaths(Data=P_2, Search=tstat_2.Paths, Replace=flatten(path_2))
pts_not_on_ground_2 = Geometry(replace)
P_3 = Positions(pts_not_on_ground_2)
pts_on_ground_2 = Geometry(replace_2)
P_4 = Positions(pts_on_ground_2)

# ----
# AGENTS
cartesian_agent = DefineCartesianAgent(Positions=P_4)
cartesian_agent_2 = DefineCartesianAgent(Positions=P_3, Behaviors=c_script.oBehavior)
merge_3 = Merge(Data1=cartesian_agent, Data2=cartesian_agent_2)  # -> flatten(Result)

E = CartesianEnvironment(c_script_2.oEnvironment)
# AGENT SYSTEM
cartesian_sys = DefineCartesianAgentSystem(CartesianAgents=merge_3, ComputeDiagram=0)

solver_silent = SilentSolver(Execute=run_2, AgentSystems=cartesian_sys, MaxIterationCount=iterations_2)  # -> DisplayGeometries, AllAgentSystems, IterationCount

ticks = Panel(solver_silent.IterationCount)

point_network = Number(ilp)
c_script_3 = CSharpScript(
    iAS=solver_silent.AllAgentSystems,
    Reference="C:\Users\siennasun513\AppData\Roaming\McNeel\Rhinoceros\packages\7.0\ABxM_Core\1.4.0\ABxM.Core.dll")  # -> out, oGeo
# ---------- c_script_3: C# ----------
    CartesianAgentSystem mySystem = iAS as CartesianAgentSystem;
    List<Point3d> agentPos = new List<Point3d>();

    if (mySystem == null)
      return;

    List < CartesianAgent > agents = new List<CartesianAgent>();

    for (int i = 0; i < mySystem.Agents.Count; i++)
    {
      CartesianAgent agent = mySystem.Agents[i] as CartesianAgent;
      agentPos.Add(agent.Position);
    }


    oGeo = agentPos;
# ---------- end c_script_3 ----------
item = ListItem(List=c_script_3.oGeo, Index=point_network, Wrap=True)
pline_6 = PolyLine(Vertices=item, Closed=True)

boundary = BoundarySurfaces(Edges=pline_6)

prune = PruneTree(Tree=boundary, Minimum=1, Maximum=0)
planar = IsPlanar(Surface=prune, Interior=True)  # -> Planar, Plane
panel_6 = Panel(planar.Planar)

# ----
# use the discretised surfaces
points = PointList(Points=pt_2, Size=0.15)
panel_7 = Panel(discretised_panel_crvs)
crv_2 = Curve(flatten(discretised_panel_crvs))
graft = GraftTree(Tree=crv_2, IncludeEmptyLists=True, IncludeNullItems=True)  # -> simplify(Tree)
item_2 = ListItem(List=crv_2, Index=Slider(77, range=0..100), Wrap=True)
explode_4 = Explode(Curve=graft, Recursive=True)  # -> simplify(Segments), simplify(Vertices)
panel_8 = Panel("""{0}
{11}""")
crv_3 = Curve(explode_4.Segments)
pt_4 = Point(simplify(flatten(explode_4.Vertices)))
branch = TreeBranch(Tree=pt_2, Path=panel_8, MaintainPaths=True)
cullpt = CullDuplicates(Points=pt_4, Tolerance=0.1, CullMode=3)  # -> Points, Indices, Valence
midpt = CurveMiddle(Curve=crv_2)
duppt_4 = RemoveDuplicatePts(Points=pt_4, Tolerance=0.01)
item_3 = ListItem(List=pt_2, Index=0, Wrap=True)  # -> Item1, Item, Item1_2, Item2
points_2 = PointList(Points=midpt, Size=0.07)
points_3 = PointList(Points=duppt_4, Size=0.03)
merge_4 = Merge(Data1=item_3.Item, Data2=item_3.Item1, Data3=branch)  # -> flatten(Result)
pdecon_2 = Deconstruct(Point=duppt_4)  # -> XComponent, YComponent, ZComponent
duppt_5 = RemoveDuplicatePts(Points=flatten(merge_4), Tolerance=0.01)
equals_2 = Equality(FirstNumber=pdecon_2.ZComponent, SecondNumber=0)  # -> Equality, Inequality
mindex_6 = MemberIndex(Set=duppt_4, Member=explode_4.Vertices)  # -> simplify(Index), Count
python_2 = GhPythonScript(iPts=duppt_4, iLines=explode_4.Vertices)  # -> out, simplify(iPL); inputs iPts: list of Point3d, iLines: tree of Point3d; same code as python
path_mapper_2 = PathMapper(mindex_6.Index, source="{a; b}", target="{a}")
dispatch_2 = Dispatch(List=duppt_4, DispatchPattern=equals_2.Equality)  # -> ListA, ListB
cps_3 = ClosestPoints(Point=duppt_5, Cloud=duppt_4, Count=1)  # -> flatten(ClosestPoint), CPIndex, Distance
point_indices_for_each_polyline_3 = Panel(path_mapper_2)
polyline_indices_for_each_point_3 = Panel(python_2.iPL)

pts_on_the_edge_curves_2 = Point(cps_3.ClosestPoint)

mindex_7 = MemberIndex(Set=duppt_4, Member=pts_on_the_edge_curves_2)  # -> flatten(Index), Count
cull_i_3 = CullIndex(List=duppt_4, Indices=mindex_7.Index, Wrap=True)

pts_not_on_the_edge_curves = Point(cull_i_3)
P_5 = Positions(simplify(graft(pts_not_on_the_edge_curves)))
# INPUT
P_6 = Positions(simplify(graft(pts_on_the_edge_curves_2)))

pts_on_ground_3 = Point(dispatch_2.ListA)
pts_not_on_ground_3 = Point(dispatch_2.ListB)

point_indices_for_each_polyline_4 = Number(path_mapper_2)
polyline_indices_for_each_point_4 = Number(python_2.iPL)

P_7 = Positions(simplify(graft(pts_on_ground_3)))
mindex_8 = MemberIndex(Set=duppt_4, Member=pts_on_ground_3)  # -> Index, Count
mindex_9 = MemberIndex(Set=duppt_4, Member=pts_not_on_ground_3)  # -> Index, Count
P_8 = Positions(simplify(graft(pts_not_on_ground_3)))
ilp_2 = ILP(point_indices_for_each_polyline_4)
ipl_2 = IPL(polyline_indices_for_each_point_4)

# ---- group: Planarize Behaviour
c_script_4 = CSharpScript(
    iPL=ipl_2,
    iLP=ilp_2,
    iF=Slider(0.3, range=0..1),
    Reference="C:\USERS\SIENNASUN513\APPDATA\ROAMING\MCNEEL\RHINOCEROS\PACKAGES\7.0\ABXM_CORE\1.4.0\ABxM.Core.dll")  # -> out, oBehavior; inputs iPL: tree of Int32, iLP: tree of Int32, iF: Double; same code as c_script

# ----
path_3 = ConstructPath(Indices=mindex_9.Index)  # -> simplify(Branch)
path_4 = ConstructPath(Indices=mindex_8.Index)  # -> simplify(Branch)
# BEHAVIOURS
tstat_3 = TreeStatistics(Tree=P_8)  # -> Paths, Length, Count
tstat_4 = TreeStatistics(Tree=P_7)  # -> Paths, Length, Count
replace_3 = ReplacePaths(Data=P_8, Search=tstat_3.Paths, Replace=flatten(path_3))
replace_4 = ReplacePaths(Data=P_7, Search=tstat_4.Paths, Replace=flatten(path_4))
pts_not_on_ground_4 = Geometry(replace_3)
P_9 = Positions(pts_not_on_ground_4)
pts_on_ground_4 = Geometry(replace_4)
P_10 = Positions(pts_on_ground_4)

# ----
# AGENTS
cartesian_agent_3 = DefineCartesianAgent(Positions=P_10)
cartesian_agent_4 = DefineCartesianAgent(Positions=P_9, Behaviors=c_script_4.oBehavior)
merge_5 = Merge(Data1=cartesian_agent_3, Data2=cartesian_agent_4)  # -> flatten(Result)

boundary_corners_2 = Point(pts_on_the_edge_curves_2)
P_11 = Positions(simplify(graft(boundary_corners_2)))
mindex_10 = MemberIndex(Set=duppt_4, Member=boundary_corners_2)  # -> Index, Count
path_5 = ConstructPath(Indices=mindex_10.Index)  # -> simplify(Branch)
# AGENT SYSTEM
cartesian_sys_2 = DefineCartesianAgentSystem(CartesianAgents=merge_5, ComputeDiagram=0)
tstat_5 = TreeStatistics(Tree=P_11)  # -> Paths, Length, Count
replace_5 = ReplacePaths(Data=P_11, Search=tstat_5.Paths, Replace=flatten(path_5))
pdecon_3 = Deconstruct(Point=pts_on_ground_3)  # -> XComponent, YComponent, ZComponent
boundary_points = Geometry(replace_5)

# ----
# CartesianEnvironment
c_script_5 = CSharpScript(
    iBoundaryCorners=boundary_points,
    Reference="C:\USERS\SIENNASUN513\APPDATA\ROAMING\MCNEEL\RHINOCEROS\PACKAGES\7.0\ABXM_CORE\1.4.0\ABxM.Core.dll")  # -> out, oEnvironment; inputs iBoundaryCorners: list of Point3d; same code as c_script_2

E_2 = CartesianEnvironment(c_script_5.oEnvironment)
panel_9 = Panel(boundary_points)
sort = SortList(Keys=pdecon_3.XComponent, ValuesA=pts_on_ground_3)  # -> Keys, ValuesA

solver_silent_2 = SilentSolver(Execute=run, AgentSystems=cartesian_sys_2, MaxIterationCount=iterations)  # -> DisplayGeometries, AllAgentSystems, IterationCount

ticks_2 = Panel(solver_silent_2.IterationCount)

point_network_2 = Number(ilp_2)
c_script_6 = CSharpScript(
    iAS=solver_silent_2.AllAgentSystems,
    Reference="C:\Users\siennasun513\AppData\Roaming\McNeel\Rhinoceros\packages\7.0\ABxM_Core\1.4.0\ABxM.Core.dll")  # -> out, oGeo; same code as c_script_3
item_4 = ListItem(List=c_script_6.oGeo, Index=point_network_2, Wrap=True)
pline_7 = PolyLine(Vertices=item_4, Closed=True)

subset_5 = SubList(List=sort.ValuesA, Domain="0 to 14", Wrap=True)  # -> List, Index
subset_6 = SubList(List=sort.ValuesA, Domain="15 to 25", Wrap=True)  # -> List, Index
pdecon_4 = Deconstruct(Point=subset_5.List)  # -> XComponent, YComponent, ZComponent
pdecon_5 = Deconstruct(Point=subset_6.List)  # -> XComponent, YComponent, ZComponent
sort_2 = SortList(Keys=pdecon_4.YComponent, ValuesA=subset_5.List)  # -> Keys, ValuesA
sort_3 = SortList(Keys=pdecon_5.YComponent, ValuesA=subset_6.List)  # -> Keys, ValuesA

boundary_2 = BoundarySurfaces(Edges=pline_7)

item_5 = ListItem(List=sort_2.ValuesA, Index=0, Wrap=True)  # -> Item1, Item
item_6 = ListItem(List=sort_3.ValuesA, Index=0, Wrap=True)  # -> Item1, Item
prune_2 = PruneTree(Tree=boundary_2, Minimum=1, Maximum=0)
merge_6 = Merge(Data1=item_5.Item1, Data2=item_5.Item, Data3=item_6.Item1, Data4=item_6.Item)
planar_2 = IsPlanar(Surface=prune_2, Interior=True)  # -> Planar, Plane
boundary_corners_3 = Point(merge_6)
panel_10 = Panel(planar_2.Planar)
